# Grasshopper definition FacadeIterationFive.gh (Grasshopper 0.9.76)
# plug-ins: MeshEdit Components, Kangaroo Components, Kangaroo2 Components

number_slider = Slider(1, range=0..1)
number_slider_2 = Slider(5, range=0..10)
xz_plane = XZPlane(Origin=Point(0, 0, 0))
hexagonal = Hexagonal(Plane=xz_plane, Size=Slider(1, range=0..1), ExtentX=number_slider_2, ExtentY=number_slider_2)  # -> Cells, Points
c_script = CSharpScript(x=hexagonal.Cells)  # -> A; inputs x: tree of Polyline
# ---------- c_script: C# ----------
    var dataTree = new DataTree<Polyline>();

    for( int i = 0; i < x.BranchCount; ++i )
      for( int j = 0; j < x.Branch(i).Count; ++j )
      {

        if( i % 2 != 1 )
        
        dataTree.Add(x.Branch(i)[j], new GH_Path(i));

      }

    A = dataTree;
# ---------- end c_script ----------
discontinuity = Discontinuity(Curve=c_script, Level=1)  # -> Points, Parameters
list_item = ListItem(List=discontinuity.Points, Index=Slider(0, range=0..5), Wrap=True)
list_item_2 = ListItem(List=discontinuity.Points, Index=Slider(3, range=0..5), Wrap=True)
line = Line(StartPoint=list_item, EndPoint=list_item_2)
divide_curve = DivideCurve(Curve=line, Count=Slider(10, range=0..10), Kinks=False)  # -> Points, Tangents, Parameters
list_item_3 = ListItem(List=divide_curve.Points, Index=Slider(3, range=0..4), Wrap=True)
list_item_4 = ListItem(List=divide_curve.Points, Index=Slider(7, range=0..10), Wrap=True)
simplifybranches = CSharpScript(points=discontinuity.Points)  # -> pointsOut; inputs points: tree of Point3d
# ---------- simplifybranches: C# ----------
    int size = points.BranchCount;
    
    var finalPoints = new DataTree<Point3d>();
    
    for( int i = 0; i < size; ++i )
      for( int j = 0; j < points.Branch(i).Count; ++j )
      {
      
        finalPoints.Add( points.Branch(i)[j], new GH_Path(i) );
      
      }
    
    pointsOut = finalPoints;
# ---------- end simplifybranches ----------
simplifybranches_2 = CSharpScript(points=list_item_3)  # -> pointsOut; inputs points: tree of Point3d; same code as simplifybranches
simplifybranches_3 = CSharpScript(points=list_item_4)  # -> pointsOut; inputs points: tree of Point3d; same code as simplifybranches
point = Point([simplifybranches, simplifybranches_2, simplifybranches_3])
meshertree = CSharpScript(points=point)  # -> simplify(meshOut); inputs points: tree of Point3d
# ---------- meshertree: C# ----------
    int size = points.BranchCount;

    var mesh = new Mesh[size];

    var organized = new Point3d[size][];

    for( int i = 0; i < size; ++i )
    {

      mesh[i] = new Mesh();
      mesh[i].Vertices.AddVertices(points.Branch(i));

      mesh[i].Faces.AddFace(3, 4, 7);
      mesh[i].Faces.AddFace(2, 3, 7);
      mesh[i].Faces.AddFace(7, 6, 1, 2);
      mesh[i].Faces.AddFace(6, 0, 1);
      mesh[i].Faces.AddFace(6, 5, 0);
      mesh[i].Faces.AddFace(6, 7, 4, 5);

    }

    meshOut = mesh;
# ---------- end meshertree ----------
mesh = Mesh([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])
mjoin = MeshJoin(Meshes=meshertree)
partition_list = PartitionList(List=meshertree, Size=number_slider_2)  # -> simplify(Chunks)
weldvertices = MeshWeldVertices(Mesh=partition_list, Tolerance=0.01)  # -> RuntimeMessage, Mesh
mesh_2 = Mesh(weldvertices.Mesh)
weldvertices_2 = MeshWeldVertices(Mesh=mesh_2, Tolerance=0.01)  # -> RuntimeMessage, Mesh
mesh_3 = Mesh(weldvertices_2.Mesh)
mesh_join = MeshJoin(Meshes=[partition_list, mesh_3])
mesh_4 = Mesh(mesh_join)
mjoin_2 = MeshJoin(Meshes=weldvertices_2.Mesh)
mesh_edges = MeshEdges(Mesh=mjoin_2)  # -> simplify(NakedEdges), simplify(InteriorEdges), simplify(NonManifoldEdges)
medges = MeshEdges(Mesh=mjoin_2)  # -> NakedEdges, InteriorEdges, NonManifoldEdges
panel = Panel("""0
1
2
3""")
line_2 = Line(mesh_edges.InteriorEdges)
mesh_5 = Mesh(weldvertices_2.Mesh)
panel_2 = Panel("6")
len = Length(Curve=mesh_edges.InteriorEdges)
number_slider_3 = Slider(2, range=0..10)
demesh = DeconstructMesh(Mesh=mesh_5)  # -> Vertices, Faces, Colours, Normals
smaller = SmallerThan(FirstNumber=len, SecondNumber=Slider(0.698, range=0..1))  # -> SmallerThan, OrEqualTo
medges_2 = MeshEdges(Mesh=mesh_4)  # -> NakedEdges, InteriorEdges, NonManifoldEdges
panel_3 = Panel(demesh.Vertices)
item = ListItem(List=demesh.Vertices, Index=panel, Wrap=True)
rad = Radians(Degrees=Slider(-180, range=-360..360))
crv = Curve([medges_2.NakedEdges, medges_2.InteriorEdges])
rad_2 = Radians(Degrees=Slider(45, range=-360..360))
points = PointList(Points=item, Size=Slider(1, range=0..1))
len_2 = Length(Curve=crv)
number_slider_4 = Slider(1, range=0..1)  # disabled
dispatch = Dispatch(List=mesh_edges.InteriorEdges, DispatchPattern=smaller.OrEqualTo)  # -> ListA, ListB
number_slider_5 = Slider(0, range=0..2)

# ---- group: GridPointNumbers
demesh_2 = DeconstructMesh(Mesh=mesh_4)  # -> Vertices, Faces, Colours, Normals
points_2 = PointList(Points=demesh_2.Vertices, Size=Slider(1, range=0..1))

# ----
multiplication = Multiplication(A=len_2, B=Slider(1, range=0..1))
length_line = LengthLine(Line=crv, Length=multiplication, Strength=10)
hingepoints = HingePoints(Mesh=mesh_4)  # -> _1, _2, _3, _4
springs = SpringsFromLine(
    Connection=crv,
    Stiffness=Slider(100, range=0..100),
    Damping=10,
    RestLength=multiplication,
    UpperCutoff=0,
    LowerCutoff=0,
    Plasticity=0)
num = Number(rad)
num_2 = Number(rad_2)
ln = Line(StartPoint=hingepoints._1, EndPoint=hingepoints._2)
c_script_2 = CSharpScript(tree=c_script)  # -> branchCount; inputs tree: tree of Polyline
# ---------- c_script_2: C# ----------
    branchCount = tree.BranchCount;
# ---------- end c_script_2 ----------
S = Springs(springs)
list_length = ListLength(List=flatten(mesh_4))
unweld = UnweldMesh(Mesh=mesh_4, Angle=0)
eval = EvaluateCurve(Curve=reparameterize(ln), Parameter=0.5)  # -> graft(Point), Tangent, Angle
medges_3 = MeshEdges(Mesh=mesh_4)  # -> NakedEdges, InteriorEdges, NonManifoldEdges
demesh_3 = DeconstructMesh(Mesh=mesh_4)  # -> Vertices, Faces, Colours, Normals
panel_4 = Panel("""1
2
4
5""")
crv_2 = Curve(mesh_edges.NakedEdges)
crv_3 = Curve(dispatch.ListB)
crv_4 = Curve(dispatch.ListA)
construct_domain = ConstructDomain(DomainStart=Slider(0, range=0..1), DomainEnd=Slider(1, range=0..1))
edgelengths = EdgeLengths(Mesh=mesh_4, LengthFactor=1, Strength=Slider(100, range=0..100))  # -> simplify(EL)
strength = Panel("1")
strength_2 = Panel("1")
plasticanchor = PlasticAnchor(Point=demesh_3.Vertices, Limit=0.01, Strength=0.01)  # -> simplify(A)
angle = Panel("pi")
length_line_2 = LengthLine(Line=[medges_3.NakedEdges, medges_3.InteriorEdges], Strength=Slider(10, range=0..100))  # -> simplify(Spring)
angle_2 = Panel("-pi")
planarize = Planarize(M=mesh_4, Strength=0.001)  # -> simplify(Planarize)
number_slider_6 = Slider(-180, range=-360..360)
num_3 = Number(strength_2)
num_4 = Number(strength)
folding = Slider(7.547, range=0..10)
points_3 = PointList(Points=hingepoints._4, Size=Slider(0.233, range=0..1))
mountains = Curve([crv_4, crv_2])
eval_2 = EvaluateCurve(Curve=reparameterize(mountains), Parameter=0.5)  # -> Point, Tangent, Angle
cp = ClosestPoint(Point=eval.Point, Cloud=eval_2.Point)  # -> ClosestPoint, CPIndex, Distance
larger = LargerThan(FirstNumber=0.01, SecondNumber=cp.Distance)  # -> LargerThan, OrEqualTo
list_item_5 = ListItem(List=demesh.Vertices, Index=panel_4, Wrap=True)
valleys = Curve(crv_3)
eval_3 = EvaluateCurve(Curve=reparameterize(valleys), Parameter=0.5)  # -> Point, Tangent, Angle
cp_2 = ClosestPoint(Point=eval.Point, Cloud=eval_3.Point)  # -> ClosestPoint, CPIndex, Distance
larger_2 = LargerThan(FirstNumber=0.01, SecondNumber=cp_2.Distance)  # -> LargerThan, OrEqualTo
cull = CullPattern(List=num_3, CullPattern=larger.LargerThan)
random = Random(Range=construct_domain, Number=c_script_2, Seed=Slider(443, range=0..1000))
unit_y = UnitY(Factor=random)
num_5 = Number(simplify(graft(random)))
multiplication_2 = Multiplication(A=num_2, B=num_5)  # -> simplify(Result)
multiplication_3 = Multiplication(A=num, B=num_5)  # -> simplify(Result)
cull_2 = CullPattern(List=num_4, CullPattern=larger_2.LargerThan)
cull_3 = CullPattern(List=multiplication_3, CullPattern=larger_2.LargerThan)
cull_4 = CullPattern(List=multiplication_2, CullPattern=larger.LargerThan)
mesh_join_2 = MeshJoin(Meshes=mesh_3)
rad_3 = Radians(Degrees=number_slider_6)
rad_4 = Radians(Degrees=Slider(45, range=-360..360))
addition = Addition(A=cull_2, B=cull)
addition_2 = Addition(A=cull_3, B=cull_4)
number_slider_7 = Slider(9.87, range=0..10)
dash = DashPattern(Curve=crv_2, Pattern="1")  # -> Dashes, Gaps
dash_2 = DashPattern(Curve=crv_3, Pattern="1")  # -> Dashes, Gaps
dash_3 = DashPattern(Curve=crv_4, Pattern="1")  # -> Dashes, Gaps
point_2 = Point([list_item_3, list_item_4])
load = Load(Point=point_2, ForceVector=unit_y)  # -> simplify(Unary)
origami = Origami(mesh=mesh_join_2, valleys=valleys, C=mountains, num_2=number_slider_6, num=folding, num_3=rad_4)  # -> flatten(data_2), flatten(R)
addition_3 = Addition(A=0, B=addition)  # -> simplify(flatten(Result))
addition_4 = Addition(A=0, B=addition_2)  # -> simplify(flatten(Result))
dupln = RemoveDuplicateLines(Lines=dash.Dashes, Tolerance=0.01)
show = Show(G=unweld)
unit_x = UnitX(Factor=folding)  # -> expr("x*9.87", UnitVector)
unit_z = UnitZ(Factor=folding)  # -> expr("x*9.87", UnitVector)
unit_y_2 = UnitY(Factor=folding)  # -> expr("-x", UnitVector)
timer = Timer(TimerInterval=20, Target=kangaroo)
multiplication_4 = Multiplication(A=Slider(183, range=0..183), B=0.333)
partition_list_2 = PartitionList(List=addition_3, Size=multiplication_4)  # -> simplify(Chunks)
partition_list_3 = PartitionList(List=addition_4, Size=multiplication_4)  # -> simplify(Chunks)
hinge = Hinge(
    FoldStart=hingepoints._1,
    FoldEnd=hingepoints._2,
    Tip1=hingepoints._3,
    Tip2=hingepoints._4,
    RestAngle=partition_list_3,
    Strength=partition_list_2)  # -> simplify(Hinge)
preview = CustomPreview(Geometry=dupln, Shader=ColourSwatch(SwatchColor=RGB(0, 72, 255)))
preview_2 = CustomPreview(Geometry=dash_2.Dashes, Shader=ColourSwatch(SwatchColor=RGB(255, 0, 0)))
preview_3 = CustomPreview(Geometry=dash_3.Dashes, Shader=ColourSwatch(SwatchColor=RGB(0, 72, 255)))
panel_5 = Panel(addition_3)
panel_6 = Panel(addition_4)
kangaroo = KangarooPhysics(
    ForceObjects=flatten(origami.data_2),
    AnchorPoints=flatten(list_item_5),
    Settings=null,
    Geometry=origami.R,
    SimulationReset=Toggle(True))  # -> Out, Iterations, ParticlesOut, GeometryOut, KE
unaryforce = UnaryForce(Point=point_2, Force=unit_y_2)
data = Data([planarize, hinge, show, length_line_2, plasticanchor])
# just double click the kangaroo to launch the timer control
panel_7 = Panel(origami.R)
data_2 = Data(data)
R = Result(unweld)
anchor = Anchor(Point=list_item_5, Strength=10000)  # -> simplify(A)
medges_4 = MeshEdges(Mesh=kangaroo.GeometryOut)  # -> NakedEdges, InteriorEdges, NonManifoldEdges
mesh_6 = Mesh(kangaroo.GeometryOut)
preview_4 = CustomPreview(
    Geometry=kangaroo.GeometryOut,
    Shader={ambient=RGB(128, 128, 128), diffuse=RGB(192, 192, 192), emission=RGB(0, 0, 0), shine=0.5, specular=RGB(255, 255, 255), transparency=0})
solver = Solver(GoalObjects=flatten(data), Reset=Button(), Threshold=1e-15, Tolerance=0.01, On=Toggle(True))  # -> I, V, O

# ==== cluster Origami: Fold a flat pattern into 3d origami
mesh = ClusterInput()
valleys = ClusterInput()

# ---- group: Mountains
C = ClusterInput()

# ---- group: Folding
num = ClusterInput()

# ---- group: -pi/2
num_2 = ClusterInput()

# ---- group: pi
num_3 = ClusterInput()

# ----
mesh_2 = Mesh(mesh)

# ---- group: GridPointNumbers
demesh = DeconstructMesh(Mesh=mesh_2)  # -> Vertices, Faces, Colours, Normals
points = PointList(Points=demesh.Vertices, Size=Slider(1, range=0..1))

# ----
hingepoints = HingePoints(Mesh=mesh_2)  # -> _1, _2, _3, _4
num_4 = Number(num)
num_5 = Number(num_2)
num_6 = Number(num_3)
ln = Line(StartPoint=hingepoints._1, EndPoint=hingepoints._2)
eval = EvaluateCurve(Curve=reparameterize(C), Parameter=0.5)  # -> Point, Tangent, Angle
eval_2 = EvaluateCurve(Curve=reparameterize(valleys), Parameter=0.5)  # -> Point, Tangent, Angle
multiplication = Multiplication(A=num_6, B=num_4)
unweld = UnweldMesh(Mesh=mesh_2, Angle=0)
eval_3 = EvaluateCurve(Curve=reparameterize(ln), Parameter=0.5)  # -> graft(Point), Tangent, Angle
multiplication_2 = Multiplication(A=num_5, B=num_4)
cp = ClosestPoint(Point=eval_3.Point, Cloud=eval.Point)  # -> ClosestPoint, CPIndex, Distance
cp_2 = ClosestPoint(Point=eval_3.Point, Cloud=eval_2.Point)  # -> ClosestPoint, CPIndex, Distance
strength = Panel("1")
strength_2 = Panel("1")

# ---- group: Forces
springsfrommesh = SpringsFromMesh(M=mesh_2, stiffness=100, B=1)
planarizequads = PlanarizeQuads(M=mesh_2, planarizestrength=1000)

# ----
larger = LargerThan(FirstNumber=0.01, SecondNumber=cp.Distance)  # -> LargerThan, OrEqualTo
num_7 = Number(strength_2)
larger_2 = LargerThan(FirstNumber=0.01, SecondNumber=cp_2.Distance)  # -> LargerThan, OrEqualTo
num_8 = Number(strength)
points_2 = PointList(Points=hingepoints._4, Size=Slider(1, range=0..1))
cull = CullPattern(List=num_7, CullPattern=larger.LargerThan)
cull_2 = CullPattern(List=num_8, CullPattern=larger_2.LargerThan)
cull_3 = CullPattern(List=multiplication_2, CullPattern=larger_2.LargerThan)
cull_4 = CullPattern(List=multiplication, CullPattern=larger.LargerThan)
addition = Addition(A=cull_2, B=cull)
addition_2 = Addition(A=cull_3, B=cull_4)
addition_3 = Addition(A=0, B=addition)  # -> flatten(Result)
addition_4 = Addition(A=0, B=addition_2)  # -> flatten(Result)
hinge = Hinge(
    Point1=hingepoints._1,
    Point2=hingepoints._2,
    Point3=hingepoints._3,
    Point4=hingepoints._4,
    Strength=addition_3,
    RestAngle=addition_4)
panel = Panel(addition_3)
panel_2 = Panel(addition_4)
data = Data([springsfrommesh, hinge, planarizequads])
data_2 = ClusterOutput(data)
R = ClusterOutput(unweld)

# ==== cluster PlanarizeQuads: Applies a planarization force to any quads in a mesh
M = ClusterInput()
mcomp = Decompose(Mesh=M)  # -> Vertices, Faces, Colours, Normals
vertices = FaceVertices(Face=mcomp.Faces)  # -> CornerA, CornerB, CornerC, CornerD
planarizestrength = ClusterInput()
item = ListItem(List=mcomp.Vertices, Index=vertices.CornerA, Wrap=False)
item_2 = ListItem(List=mcomp.Vertices, Index=vertices.CornerB, Wrap=False)
item_3 = ListItem(List=mcomp.Vertices, Index=vertices.CornerC, Wrap=False)
item_4 = ListItem(List=mcomp.Vertices, Index=vertices.CornerD, Wrap=False)
planarize = Planarize(Point1=item, Point2=item_2, Point3=item_3, Point4=item_4, PlanarizeStrength=planarizestrength)
equals = Equality(FirstNumber=vertices.CornerC, SecondNumber=vertices.CornerD)  # -> Equality, Inequality
cull = CullPattern(List=planarize, CullPattern=equals.Inequality)
L = ClusterOutput(cull)

# ==== cluster SpringsFromMesh: Turns all edges of a mesh into springs
M = ClusterInput()
medges = MeshEdges(Mesh=M)  # -> NakedEdges, InteriorEdges, NonManifoldEdges
crv = Curve([medges.NakedEdges, medges.InteriorEdges])
B = ClusterInput()
len = Length(Curve=crv)
multiplication = Multiplication(A=len, B=B)
stiffness = ClusterInput()
springs = SpringsFromLine(Connection=crv, Stiffness=stiffness, Damping=10, RestLength=multiplication, UpperCutoff=0, LowerCutoff=0, Plasticity=0)
S = ClusterOutput(springs)
