# Grasshopper definition FacadeIterationFour.gh (Grasshopper 0.9.76)
# plug-ins: MeshEdit Components, Kangaroo Components, Kangaroo2 Components

number_slider = Slider(1, range=0..10)
hexagonal = Hexagonal(Plane=PlaneXY(0, 0, 0), Size=Slider(1, range=0..1), ExtentX=number_slider, ExtentY=number_slider)  # -> Cells, Points
discontinuity = Discontinuity(Curve=hexagonal.Cells, Level=1)  # -> Points, Parameters
list_item = ListItem(List=discontinuity.Points, Index=Slider(0, range=0..5), Wrap=True)
list_item_2 = ListItem(List=discontinuity.Points, Index=Slider(3, range=0..5), Wrap=True)
line = Line(StartPoint=list_item, EndPoint=list_item_2)
divide_curve = DivideCurve(Curve=line, Count=Slider(10, range=0..10), Kinks=False)  # -> Points, Tangents, Parameters
list_item_3 = ListItem(List=divide_curve.Points, Index=Slider(3, range=0..4), Wrap=True)
list_item_4 = ListItem(List=divide_curve.Points, Index=Slider(7, range=0..10), Wrap=True)
rowcount = Slider(10, range=0..10)
simplifybranches = CSharpScript(points=discontinuity.Points)  # -> pointsOut; inputs points: tree of Point3d
# ---------- simplifybranches: C# ----------
    int size = points.BranchCount;
    
    var finalPoints = new DataTree<Point3d>();
    
    for( int i = 0; i < size; ++i )
      for( int j = 0; j < points.Branch(i).Count; ++j )
      {
      
        finalPoints.Add( points.Branch(i)[j], new GH_Path(i) );
      
      }
    
    pointsOut = finalPoints;
# ---------- end simplifybranches ----------
simplifybranches_2 = CSharpScript(points=list_item_3)  # -> pointsOut; inputs points: tree of Point3d; same code as simplifybranches
simplifybranches_3 = CSharpScript(points=list_item_4)  # -> pointsOut; inputs points: tree of Point3d; same code as simplifybranches
point = Point([simplifybranches, simplifybranches_2, simplifybranches_3])
hexagonal_2 = Hexagonal(Plane=PlaneXY(0, 0, 0), Size=1, ExtentX=Slider(1, range=0..1), ExtentY=rowcount)  # -> Cells, Points
meshertree = CSharpScript(points=point)  # -> simplify(meshOut); inputs points: tree of Point3d
# ---------- meshertree: C# ----------
    int size = points.BranchCount;

    var mesh = new Mesh[size];

    var organized = new Point3d[size][];

    for( int i = 0; i < size; ++i )
    {

      mesh[i] = new Mesh();
      mesh[i].Vertices.AddVertices(points.Branch(i));

      mesh[i].Faces.AddFace(3, 4, 7);
      mesh[i].Faces.AddFace(2, 3, 7);
      mesh[i].Faces.AddFace(7, 6, 1, 2);
      mesh[i].Faces.AddFace(6, 0, 1);
      mesh[i].Faces.AddFace(6, 5, 0);
      mesh[i].Faces.AddFace(6, 7, 4, 5);

    }

    meshOut = mesh;
# ---------- end meshertree ----------
point_2 = Point(hexagonal_2.Points)
c_script = CSharpScript(C=point_2)  # -> Shifted, A; inputs C: tree of Point3d
# ---------- c_script: C# ----------
    var treeOut = new DataTree<Point3d>();

    int count = C.BranchCount;

    var test = new List<int>();
    
    for( int i = 0; i < count; ++i )
      for( int j = 0; j < C.Branch(i).Count; ++j )
      {

        if( i % 2 != 0 )
        
        test.Add(j);
          
        treeOut.Add(C.Branch(i)[j], new GH_Path(j));
          
      }

    Shifted = treeOut;

    A = test;
# ---------- end c_script ----------
mesh = Mesh([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])
mjoin = MeshJoin(Meshes=meshertree)
weldvertices = MeshWeldVertices(Mesh=mjoin, Tolerance=0.01)  # -> RuntimeMessage, Mesh
vec2pt = Vector2Pt(PointA="0,0,0", PointB=c_script.Shifted, Unitize=False)  # -> Vector, Length
folding = Slider(0.127, range=0..0.99)
angle = Panel("pi")
angle_2 = Panel("-pi")
demesh = DeconstructMesh(Mesh=weldvertices.Mesh)  # -> Vertices, Faces, Colours, Normals
move = Move(Geometry=weldvertices.Mesh, Motion=vec2pt.Vector)  # -> Geometry, Transform
mesh_2 = Mesh(move.Geometry)
points = PointList(Points=demesh.Vertices, Size=Slider(1, range=0..1))
weldvertices_2 = MeshWeldVertices(Mesh=mesh_2, Tolerance=0.01)  # -> RuntimeMessage, Mesh
mesh_edges = MeshEdges(Mesh=weldvertices_2.Mesh)  # -> flatten(NakedEdges), flatten(InteriorEdges), NonManifoldEdges
mjoin_2 = MeshJoin(Meshes=flatten(weldvertices_2.Mesh))
medges = MeshEdges(Mesh=mjoin_2)  # -> NakedEdges, InteriorEdges, NonManifoldEdges
panel = Panel("""0
1
2
3""")
line_2 = Line(mesh_edges.InteriorEdges)
mesh_3 = Mesh(weldvertices_2.Mesh)
panel_2 = Panel(mesh_edges.InteriorEdges)
panel_3 = Panel("6")
len = Length(Curve=mesh_edges.InteriorEdges)
number_slider_2 = Slider(2, range=0..10)
demesh_2 = DeconstructMesh(Mesh=mesh_3)  # -> Vertices, Faces, Colours, Normals
smaller = SmallerThan(FirstNumber=len, SecondNumber=Slider(0.698, range=0..1))  # -> SmallerThan, OrEqualTo
panel_4 = Panel(demesh_2.Vertices)
item = ListItem(List=demesh_2.Vertices, Index=panel, Wrap=True)
points_2 = PointList(Points=item, Size=Slider(1, range=0..1))
dispatch = Dispatch(List=mesh_edges.InteriorEdges, DispatchPattern=smaller.OrEqualTo)  # -> ListA, ListB
panel_5 = Panel(dispatch.ListA)
panel_6 = Panel(dispatch.ListB)
panel_7 = Panel("""1
2
4
5""")
crv = Curve(mesh_edges.NakedEdges)
crv_2 = Curve(dispatch.ListB)
crv_3 = Curve(dispatch.ListA)
folding_2 = Slider(0.503, range=-1..1)
mountains = Curve(flatten([crv_3, crv]))

# ---- group: Mountain fold lines
crv_4 = Curve(mountains)

# ----
valleys = Curve(flatten(crv_2))

# ---- group: Valley fold lines
crv_5 = Curve(valleys)

# ----
list_item_5 = ListItem(List=demesh_2.Vertices, Index=panel_7, Wrap=True)
rad = Radians(Degrees=Slider(-180, range=-360..360))
rad_2 = Radians(Degrees=Slider(45, range=-360..360))
dash = DashPattern(Curve=crv, Pattern="1")  # -> Dashes, Gaps
dash_2 = DashPattern(Curve=crv_2, Pattern="1")  # -> Dashes, Gaps
dash_3 = DashPattern(Curve=crv_3, Pattern="1")  # -> Dashes, Gaps
mesh_4 = Mesh(mjoin_2)

# ---- group: mesh of flat folding pattern
# This version should also work with meshes that include quads.
mesh_5 = Mesh(mesh_4)

# ----
tri = Triangulate(Mesh=mesh_5)  # -> Mesh, Count

hingepoints = HingePoints(Mesh=mesh_5)  # -> _1, _2, _3, _4
multiplication = Multiplication(A=rad, B=folding)
multiplication_2 = Multiplication(A=rad_2, B=folding)
ln = Line(StartPoint=hingepoints._1, EndPoint=hingepoints._2)
show = Show(G=mesh_5)
hinge = Hinge(
    FoldStart=hingepoints._1,
    FoldEnd=hingepoints._2,
    Tip1=hingepoints._3,
    Tip2=hingepoints._4,
    RestAngle=multiplication_2,
    Strength=0.01)
hinge_2 = Hinge(
    FoldStart=hingepoints._1,
    FoldEnd=hingepoints._2,
    Tip1=hingepoints._3,
    Tip2=hingepoints._4,
    RestAngle=multiplication,
    Strength=0.01)
eval = EvaluateCurve(Curve=reparameterize(crv_5), Parameter=0.5)  # -> Point, Tangent, Angle
eval_2 = EvaluateCurve(Curve=reparameterize(crv_4), Parameter=0.5)  # -> Point, Tangent, Angle
eval_3 = EvaluateCurve(Curve=ln, Parameter=0.5)  # -> graft(Point), Tangent, Angle
dist = Distance(PointA=eval.Point, PointB=eval_3.Point)
dist_2 = Distance(PointA=eval_2.Point, PointB=eval_3.Point)
sort = SortList(Keys=dist)  # -> Keys, ValuesA
sort_2 = SortList(Keys=dist_2)  # -> Keys, ValuesA
item_2 = ListItem(List=sort.Keys, Index=0, Wrap=True)
item_3 = ListItem(List=sort_2.Keys, Index=0, Wrap=True)
smaller_2 = SmallerThan(FirstNumber=item_2, SecondNumber=0.01)  # -> flatten(SmallerThan), OrEqualTo
smaller_3 = SmallerThan(FirstNumber=item_3, SecondNumber=0.01)  # -> flatten(SmallerThan), OrEqualTo
cull = CullPattern(List=hinge_2, CullPattern=smaller_2.SmallerThan)
cull_2 = CullPattern(List=hinge, CullPattern=smaller_3.SmallerThan)

# ---- group: maintain edge lengths
medges_2 = MeshEdges(Mesh=mesh_5)  # -> NakedEdges, InteriorEdges, NonManifoldEdges
length_line = LengthLine(Line=[medges_2.NakedEdges, medges_2.InteriorEdges], Strength=10)

# ---- group: a weak plastic anchor on all points prevents drift
demesh_3 = DeconstructMesh(Mesh=mesh_5)  # -> Vertices, Faces, Colours, Normals
plasticanchor = PlasticAnchor(Point=demesh_3.Vertices, Limit=0.01, Strength=0.01)

# ----
planarize = Planarize(M=mesh_5, Strength=0.001)
solver = Solver(
    GoalObjects=[length_line, cull, cull_2, show, plasticanchor, planarize],
    Reset=Button(),
    Threshold=1e-15,
    Tolerance=0.01,
    On=Toggle(True))  # -> I, V, O
anchorxyz = AnchorXYZ(Point=list_item_5, ConstrainX=True, ConstrainY=True, ConstrainZ=True)
origami = Origami(mesh=flatten(mesh_4), valleys=valleys, C=mountains, num_2=rad, num=expr("-x", folding_2), num_3=rad_2)  # -> flatten(data_2), flatten(R)
dupln = RemoveDuplicateLines(Lines=dash.Dashes, Tolerance=0.01)
timer = Timer(TimerInterval=20, Target=kangaroo)
preview = CustomPreview(Geometry=dupln, Shader=ColourSwatch(SwatchColor=RGB(0, 72, 255)))
preview_2 = CustomPreview(Geometry=dash_2.Dashes, Shader=ColourSwatch(SwatchColor=RGB(255, 0, 0)))
preview_3 = CustomPreview(Geometry=dash_3.Dashes, Shader=ColourSwatch(SwatchColor=RGB(0, 72, 255)))
kangaroo = KangarooPhysics(
    ForceObjects=origami.data_2,
    AnchorPoints=flatten(list_item_5),
    Settings=null,
    Geometry=origami.R,
    SimulationReset=Toggle(True))  # -> Out, Iterations, ParticlesOut, GeometryOut, KE
# just double click the kangaroo to launch the timer control
panel_8 = Panel(origami.R)
medges_3 = MeshEdges(Mesh=kangaroo.GeometryOut)  # -> NakedEdges, InteriorEdges, NonManifoldEdges
preview_4 = CustomPreview(
    Geometry=kangaroo.GeometryOut,
    Shader={ambient=RGB(128, 128, 128), diffuse=RGB(192, 192, 192), emission=RGB(0, 0, 0), shine=0.5, specular=RGB(255, 255, 255), transparency=0})
mesh_6 = Mesh(kangaroo.GeometryOut)

# ==== cluster Origami: Fold a flat pattern into 3d origami
mesh = ClusterInput()
valleys = ClusterInput()

# ---- group: Mountains
C = ClusterInput()

# ---- group: Folding
num = ClusterInput()

# ---- group: -pi/2
num_2 = ClusterInput()

# ---- group: pi
num_3 = ClusterInput()

# ----
mesh_2 = Mesh(mesh)

# ---- group: GridPointNumbers
demesh = DeconstructMesh(Mesh=mesh_2)  # -> Vertices, Faces, Colours, Normals
points = PointList(Points=demesh.Vertices, Size=Slider(1, range=0..1))

# ----
hingepoints = HingePoints(Mesh=mesh_2)  # -> _1, _2, _3, _4
num_4 = Number(num)
num_5 = Number(num_2)
num_6 = Number(num_3)
ln = Line(StartPoint=hingepoints._1, EndPoint=hingepoints._2)
eval = EvaluateCurve(Curve=reparameterize(C), Parameter=0.5)  # -> Point, Tangent, Angle
eval_2 = EvaluateCurve(Curve=reparameterize(valleys), Parameter=0.5)  # -> Point, Tangent, Angle
multiplication = Multiplication(A=num_6, B=num_4)
unweld = UnweldMesh(Mesh=mesh_2, Angle=0)
eval_3 = EvaluateCurve(Curve=reparameterize(ln), Parameter=0.5)  # -> graft(Point), Tangent, Angle
multiplication_2 = Multiplication(A=num_5, B=num_4)
cp = ClosestPoint(Point=eval_3.Point, Cloud=eval.Point)  # -> ClosestPoint, CPIndex, Distance
cp_2 = ClosestPoint(Point=eval_3.Point, Cloud=eval_2.Point)  # -> ClosestPoint, CPIndex, Distance
strength = Panel("1")
strength_2 = Panel("1")

# ---- group: Forces
springsfrommesh = SpringsFromMesh(M=mesh_2, stiffness=100, B=1)
planarizequads = PlanarizeQuads(M=mesh_2, planarizestrength=1000)

# ----
larger = LargerThan(FirstNumber=0.01, SecondNumber=cp.Distance)  # -> LargerThan, OrEqualTo
num_7 = Number(strength_2)
larger_2 = LargerThan(FirstNumber=0.01, SecondNumber=cp_2.Distance)  # -> LargerThan, OrEqualTo
num_8 = Number(strength)
points_2 = PointList(Points=hingepoints._4, Size=Slider(1, range=0..1))
cull = CullPattern(List=num_7, CullPattern=larger.LargerThan)
cull_2 = CullPattern(List=num_8, CullPattern=larger_2.LargerThan)
cull_3 = CullPattern(List=multiplication_2, CullPattern=larger_2.LargerThan)
cull_4 = CullPattern(List=multiplication, CullPattern=larger.LargerThan)
addition = Addition(A=cull_2, B=cull)
addition_2 = Addition(A=cull_3, B=cull_4)
addition_3 = Addition(A=0, B=addition)  # -> flatten(Result)
addition_4 = Addition(A=0, B=addition_2)  # -> flatten(Result)
hinge = Hinge(
    Point1=hingepoints._1,
    Point2=hingepoints._2,
    Point3=hingepoints._3,
    Point4=hingepoints._4,
    Strength=addition_3,
    RestAngle=addition_4)
panel = Panel(addition_3)
panel_2 = Panel(addition_4)
data = Data([springsfrommesh, hinge, planarizequads])
data_2 = ClusterOutput(data)
R = ClusterOutput(unweld)

# ==== cluster PlanarizeQuads: Applies a planarization force to any quads in a mesh
M = ClusterInput()
mcomp = Decompose(Mesh=M)  # -> Vertices, Faces, Colours, Normals
vertices = FaceVertices(Face=mcomp.Faces)  # -> CornerA, CornerB, CornerC, CornerD
planarizestrength = ClusterInput()
item = ListItem(List=mcomp.Vertices, Index=vertices.CornerA, Wrap=False)
item_2 = ListItem(List=mcomp.Vertices, Index=vertices.CornerB, Wrap=False)
item_3 = ListItem(List=mcomp.Vertices, Index=vertices.CornerC, Wrap=False)
item_4 = ListItem(List=mcomp.Vertices, Index=vertices.CornerD, Wrap=False)
planarize = Planarize(Point1=item, Point2=item_2, Point3=item_3, Point4=item_4, PlanarizeStrength=planarizestrength)
equals = Equality(FirstNumber=vertices.CornerC, SecondNumber=vertices.CornerD)  # -> Equality, Inequality
cull = CullPattern(List=planarize, CullPattern=equals.Inequality)
L = ClusterOutput(cull)

# ==== cluster SpringsFromMesh: Turns all edges of a mesh into springs
M = ClusterInput()
medges = MeshEdges(Mesh=M)  # -> NakedEdges, InteriorEdges, NonManifoldEdges
crv = Curve([medges.NakedEdges, medges.InteriorEdges])
B = ClusterInput()
len = Length(Curve=crv)
multiplication = Multiplication(A=len, B=B)
stiffness = ClusterInput()
springs = SpringsFromLine(Connection=crv, Stiffness=stiffness, Damping=10, RestLength=multiplication, UpperCutoff=0, LowerCutoff=0, Plasticity=0)
S = ClusterOutput(springs)
