# Grasshopper definition FacadeIterationThree.gh (Grasshopper 0.9.76)
# plug-ins: MeshEdit Components, Kangaroo Components, Kangaroo2 Components

number_slider = Slider(1, range=0..1)
number_slider_2 = Slider(1, range=0..10)
hexagonal = Hexagonal(Plane=PlaneXY(0, 0, 0), Size=number_slider, ExtentX=number_slider_2, ExtentY=number_slider_2)  # -> Cells, Points
discontinuity = Discontinuity(Curve=hexagonal.Cells, Level=1)  # -> Points, Parameters
list_item = ListItem(List=discontinuity.Points, Index=Slider(0, range=0..5), Wrap=True)
list_item_2 = ListItem(List=discontinuity.Points, Index=Slider(3, range=0..5), Wrap=True)
line = Line(StartPoint=list_item, EndPoint=list_item_2)
number_slider_3 = Slider(1, range=0..1)
rowcount = Slider(6, range=0..10)
number_slider_4 = Slider(2, range=0..10)
divide_curve = DivideCurve(Curve=line, Count=Slider(10, range=0..10), Kinks=False)  # -> Points, Tangents, Parameters
hexagonal_2 = Hexagonal(Plane=PlaneXY(0, 0, 0), Size=1, ExtentX=rowcount, ExtentY=rowcount)  # -> Cells, Points
point = Point(hexagonal_2.Points)
list_item_3 = ListItem(List=divide_curve.Points, Index=Slider(3, range=0..4), Wrap=True)
list_item_4 = ListItem(List=divide_curve.Points, Index=Slider(7, range=0..10), Wrap=True)
multiplication = Multiplication(A=number_slider, B=Slider(0.624, range=0..1))
c_script = CSharpScript(C=point)  # -> Shifted, A; inputs C: tree of Point3d
# ---------- c_script: C# ----------
    var treeOut = new DataTree<Point3d>();

    int count = C.BranchCount;

    var test = new List<int>();
    
    for( int i = 0; i < count; ++i )
      for( int j = 0; j < C.Branch(i).Count; ++j )
      {

        if( i % 2 != 0 )
        
        test.Add(j);
          
        treeOut.Add(C.Branch(i)[j], new GH_Path(j));
          
      }

    Shifted = treeOut;

    A = test;
# ---------- end c_script ----------
simplifybranches = CSharpScript(points=discontinuity.Points)  # -> pointsOut; inputs points: tree of Point3d
# ---------- simplifybranches: C# ----------
    int size = points.BranchCount;
    
    var finalPoints = new DataTree<Point3d>();
    
    for( int i = 0; i < size; ++i )
      for( int j = 0; j < points.Branch(i).Count; ++j )
      {
      
        finalPoints.Add( points.Branch(i)[j], new GH_Path(i) );
      
      }
    
    pointsOut = finalPoints;
# ---------- end simplifybranches ----------
simplifybranches_2 = CSharpScript(points=list_item_3)  # -> pointsOut; inputs points: tree of Point3d; same code as simplifybranches
simplifybranches_3 = CSharpScript(points=list_item_4)  # -> pointsOut; inputs points: tree of Point3d; same code as simplifybranches
point_2 = Point([simplifybranches, simplifybranches_2, simplifybranches_3])
vector_2pt = Vector2Pt(PointA=hexagonal.Points, PointB=c_script.Shifted, Unitize=False)  # -> Vector, Length
construct_path = ConstructPath(Indices=Slider(0, range=0..100))
tree_branch = TreeBranch(Tree=point_2, Path=construct_path, MaintainPaths=True)
meshertree = CSharpScript(points=point_2)  # -> simplify(meshOut); inputs points: tree of Point3d
# ---------- meshertree: C# ----------
    int size = points.BranchCount;

    var mesh = new Mesh[size];

    var organized = new Point3d[size][];

    for( int i = 0; i < size; ++i )
    {

      mesh[i] = new Mesh();
      mesh[i].Vertices.AddVertices(points.Branch(i));

      mesh[i].Faces.AddFace(3, 4, 7);
      mesh[i].Faces.AddFace(2, 3, 7);
      mesh[i].Faces.AddFace(7, 6, 1, 2);
      mesh[i].Faces.AddFace(6, 0, 1);
      mesh[i].Faces.AddFace(6, 5, 0);
      mesh[i].Faces.AddFace(6, 7, 4, 5);

    }

    meshOut = mesh;
# ---------- end meshertree ----------
meshertree_2 = CSharpScript(points=point_2)  # -> simplify(meshOut); inputs points: tree of Point3d
# ---------- meshertree_2: C# ----------
    int size = points.BranchCount;

    var mesh = new Mesh[size];

    var organized = new Point3d[size][];

    for( int i = 0; i < size; ++i )
    {

      mesh[i] = new Mesh();
      mesh[i].Vertices.AddVertices(points.Branch(i));

      mesh[i].Faces.AddFace(3, 4, 7);
      mesh[i].Faces.AddFace(2, 3, 7);
      mesh[i].Faces.AddFace(2, 7, 1);
      mesh[i].Faces.AddFace(6, 1, 7);
      mesh[i].Faces.AddFace(6, 0, 1);
      mesh[i].Faces.AddFace(6, 5, 0);
      mesh[i].Faces.AddFace(6, 7, 4);
      mesh[i].Faces.AddFace(6, 4, 5);

    }

    meshOut = mesh;
# ---------- end meshertree_2 ----------
panel = Panel("""2
3""")
delaunay_mesh = DelaunayMesh(Points=point_2, Plane=PlaneXY(0, 0, 0))
point_list = PointList(Points=tree_branch, Size=Slider(0.2, range=0..1))
multiplication_2 = Multiplication(A=vector_2pt.Vector, B=Slider(1, range=0..10))
move = Move(Geometry=meshertree, Motion=multiplication_2)  # -> Geometry, Transform
medges = MeshEdges(Mesh=move.Geometry)  # -> NakedEdges, InteriorEdges, NonManifoldEdges
len = Length(Curve=medges.InteriorEdges)
smaller = SmallerThan(FirstNumber=len, SecondNumber=multiplication)  # -> SmallerThan, OrEqualTo
dispatch = Dispatch(List=medges.InteriorEdges, DispatchPattern=smaller.OrEqualTo)  # -> ListA, ListB
curve = Curve(simplify(medges.NakedEdges))
curve_2 = Curve(simplify(dispatch.ListA))
curve_3 = Curve(simplify(dispatch.ListB))
cull_index = CullIndex(List=curve, Indices=panel, Wrap=True)
list_item_5 = ListItem(List=curve, Index=panel, Wrap=True)
list_item_6 = ListItem(List=curve, Index=0, Wrap=True)  # -> Item, Item1
list_item_7 = ListItem(List=curve, Index=1, Wrap=True)
pi = Pi(Factor=1)
custom_preview = CustomPreview(Geometry=curve, Shader=ColourSwatch(SwatchColor=RGB(0, 0, 255)))
custom_preview_2 = CustomPreview(Geometry=list_item_6.Item, Shader=ColourSwatch(SwatchColor=RGB(255, 0, 0)))
custom_preview_3 = CustomPreview(Geometry=list_item_7, Shader=ColourSwatch(SwatchColor=RGB(255, 0, 0)))
rad = Radians(Degrees=Slider(-180, range=-360..360))
rad_2 = Radians(Degrees=Slider(45, range=-360..360))
folding = Slider(0.474, range=0..1)
angle = Panel("-pi")
crv = Curve([curve_2, list_item_5])
angle_2 = Panel("pi")
crv_2 = Curve([curve, curve_3])
mesh = Mesh(move.Geometry)
multiplication_3 = Multiplication(A=pi, B=-1)
curve_4 = Curve([<curve referenced from the Rhino model> x10])
curve_5 = Curve([<curve referenced from the Rhino model> x4])
multiplication_4 = Multiplication(A=multiplication_3, B=folding)
multiplication_5 = Multiplication(A=pi, B=folding)
curve_6 = Curve([curve_2, curve_3, curve_4, curve_5])
mesh_join = MeshJoin(Meshes=flatten(mesh))
branchrearrange = CSharpScript(lines=curve_6)  # -> flatten(A); inputs lines: tree of Line
# ---------- branchrearrange: C# ----------
    var linesOut = new DataTree<Line>();
    
    for( int i = 0; i < lines.BranchCount; ++i )
      for( int j = 0; j < lines.Branch(i).Count; ++j )
      {
      
        linesOut.Add( lines.Branch(i)[j], new GH_Path(i) );
      
      }
    
    A = linesOut;
# ---------- end branchrearrange ----------
folding_2 = Slider(-0.098, range=-1..1)
folding_3 = Slider(-0.25, range=-1..1)
folding_4 = Slider(-0.307, range=-1..1)
folding_5 = Slider(0, range=0..1)
folding_6 = Slider(-0.098, range=-1..1)
folding_7 = Slider(-0.25, range=-1..1)
folding_8 = Slider(0.282, range=-1..1)
folding_9 = Slider(0.035, range=-1..1)
folding_10 = Slider(0.447, range=0..7.4)
weldvertices = MeshWeldVertices(Mesh=mesh_join, Tolerance=0.01)  # -> RuntimeMessage, Mesh
multiplication_6 = Multiplication(A=angle, B=folding_2)
multiplication_7 = Multiplication(A=angle, B=folding_3)
multiplication_8 = Multiplication(A=angle, B=folding_4)
multiplication_9 = Multiplication(A=angle, B=folding_5)
multiplication_10 = Multiplication(A=angle, B=folding_9)
multiplication_11 = Multiplication(A=angle, B=folding_6)
multiplication_12 = Multiplication(A=angle, B=folding_7)
multiplication_13 = Multiplication(A=angle, B=folding_8)
multiplication_14 = Multiplication(A=angle, B=folding_10)
mjoin = MeshJoin(Meshes=flatten(weldvertices.Mesh))
num = Number(simplify(graft(multiplication_9)))
dom = ConstructDomain(DomainStart=0, DomainEnd=expr("-x", multiplication_14))
lng = ListLength(List=flatten(move.Geometry))
mesh_2 = Mesh(mesh)
mesh_edges = MeshEdges(Mesh=mesh_2)  # -> NakedEdges, InteriorEdges, NonManifoldEdges
len_2 = Length(Curve=mesh_edges.InteriorEdges)
smaller_2 = SmallerThan(FirstNumber=len_2, SecondNumber=Slider(0.704, range=0..1))  # -> SmallerThan, OrEqualTo
crv_3 = Curve(mesh_edges.NakedEdges)
dispatch_2 = Dispatch(List=mesh_edges.InteriorEdges, DispatchPattern=smaller_2.OrEqualTo)  # -> ListA, ListB
crv_4 = Curve(dispatch_2.ListB)
crv_5 = Curve(dispatch_2.ListA)
crv_6 = Curve(simplify([crv_3, crv_4]))
crv_7 = Curve(simplify(crv_5))
random = Random(Range=dom, Number=lng, Seed=Slider(672, range=0..1000))  # -> simplify(graft(Random))
medges_2 = MeshEdges(Mesh=mesh_2)  # -> simplify(NakedEdges), simplify(InteriorEdges), simplify(NonManifoldEdges)
demesh = DeconstructMesh(Mesh=mesh_2)  # -> simplify(Vertices), Faces, Colours, Normals
hingepoints = HingePoints(Mesh=weldvertices.Mesh)  # -> _1, _2, _3, _4
hingepoints_2 = HingePoints(Mesh=mesh_2)  # -> _1, _2, _3, _4
show = Show(G=mesh_2)
ln = Line(StartPoint=hingepoints._1, EndPoint=hingepoints._2)  # -> simplify(Line)
evaluate_length = EvaluateLength(Curve=reparameterize(ln), Length=Slider(0.5, range=0..1), Normalized=True)  # -> Point, Tangent, Parameter
ln_2 = Line(StartPoint=hingepoints_2._1, EndPoint=hingepoints_2._2)  # -> simplify(Line)
plasticanchor = PlasticAnchor(Point=demesh.Vertices, Limit=0.01, Strength=0.001)
length_line = LengthLine(Line=[medges_2.NakedEdges, medges_2.InteriorEdges], Strength=1)
line_2 = Line([medges_2.NakedEdges, medges_2.InteriorEdges])
deconstruct = Deconstruct(Point=evaluate_length.Point)  # -> XComponent, YComponent, ZComponent
hinge = Hinge(
    FoldStart=simplify(hingepoints_2._1),
    FoldEnd=simplify(hingepoints_2._2),
    Tip1=simplify(hingepoints_2._3),
    Tip2=simplify(hingepoints_2._4),
    RestAngle=simplify(multiplication_5),
    Strength=0.1)  # -> simplify(Hinge)
hinge_2 = Hinge(
    FoldStart=simplify(hingepoints_2._1),
    FoldEnd=simplify(hingepoints_2._2),
    Tip1=simplify(hingepoints_2._3),
    Tip2=simplify(hingepoints_2._4),
    RestAngle=simplify(multiplication_4),
    Strength=0.1)  # -> simplify(Hinge)
eval = EvaluateCurve(Curve=ln, Parameter=0.5)  # -> graft(Point), Tangent, Angle
eval_2 = EvaluateCurve(Curve=reparameterize(crv_6), Parameter=0.5)  # -> Point, Tangent, Angle
eval_3 = EvaluateCurve(Curve=reparameterize(crv_7), Parameter=0.5)  # -> Point, Tangent, Angle
number_slider_5 = Slider(3951, range=0..10000)
deconstruct_mesh = DeconstructMesh(Mesh=mesh)  # -> Vertices, Faces, Colours, Normals
multiplication_15 = Multiplication(A=deconstruct.XComponent, B=Slider(1273, range=0..10000))
dist = Distance(PointA=eval_2.Point, PointB=eval.Point)
dist_2 = Distance(PointA=eval_3.Point, PointB=eval.Point)
sort = SortList(Keys=dist)  # -> Keys, ValuesA
sort_2 = SortList(Keys=dist_2)  # -> Keys, ValuesA
item = ListItem(List=sort.Keys, Index=0, Wrap=True)
addition = Addition(A=multiplication_15, B=Slider(10, range=0..100))
item_2 = ListItem(List=sort_2.Keys, Index=0, Wrap=True)
panel_2 = Panel("""6
7""")
panel_3 = Panel("""1
2
4
5""")
c_script_2 = CSharpScript(x=deconstruct_mesh.Vertices)  # -> A; inputs x: tree of Point3d
# ---------- c_script_2: C# ----------
    var count = x.BranchCount;
    
    var pointsOut = new DataTree<Point3d>();
    
    for( int i = 1; i < count - 1; ++i )
      for( int j = 0; j < x.Branch(i).Count; ++j )
      {
        
        pointsOut.Add( x.Branch(i)[1], new GH_Path(i) );
        pointsOut.Add( x.Branch(i)[2], new GH_Path(i) );
        pointsOut.Add( x.Branch(i)[4], new GH_Path(i) );
        pointsOut.Add( x.Branch(i)[5], new GH_Path(i) );
      
      }
    
    A = pointsOut;
# ---------- end c_script_2 ----------
smaller_3 = SmallerThan(FirstNumber=item, SecondNumber=0.01)  # -> flatten(SmallerThan), OrEqualTo
evaluate = Evaluate(Expression="10000 * P.x + 100 * P.y", P=evaluate_length.Point)
smaller_4 = SmallerThan(FirstNumber=item_2, SecondNumber=0.01)  # -> flatten(SmallerThan), OrEqualTo
item_3 = ListItem(List=deconstruct_mesh.Vertices, Index=panel_3, Wrap=True)  # -> simplify(Item)
multiplication_16 = Multiplication(A=deconstruct.YComponent, B=addition)
list_item_8 = ListItem(List=deconstruct_mesh.Vertices, Index=panel_2, Wrap=True)
cull = CullPattern(List=hinge_2, CullPattern=smaller_3.SmallerThan)
cull_2 = CullPattern(List=hinge, CullPattern=smaller_4.SmallerThan)
unit_z = UnitZ(Factor=folding)  # -> expr("x*0.1", UnitVector)
pt = Point(item_3)
sort_list = SortList(Keys=addition, ValuesA=ln)  # -> Keys, ValuesA
load = Load(Point=list_item_8, ForceVector=unit_z)  # -> flatten(Unary)
anchor = Anchor(Point=pt, Strength=10000)  # -> flatten(A)
list_item_9 = ListItem(List=sort_list.ValuesA, Index=Slider(63, range=0..100), Wrap=True)
reset = Button()
data = Data([length_line, show, plasticanchor, cull, cull_2])
solver = Solver(GoalObjects=data, Reset=reset, Threshold=1e-15, Tolerance=0.01, On=Toggle(True))  # -> I, V, O
onlybreps = CSharpScript(x=solver.O)  # -> out, A; inputs x: tree
# ---------- onlybreps: C# ----------
    var meshOut = new List<object>();

    for( int i = 0; i < x.BranchCount; ++i )
      for( int j = 0; j < x.Branch(i).Count; ++j )
      {
  
        if( x.Branch(i)[j] != null )
          
          if( x.Branch(i)[j].GetType() == typeof( Rhino.Geometry.Mesh ) )
        
            meshOut.Add(x.Branch(i)[j]);
  
      }

    A = meshOut;
# ---------- end onlybreps ----------
deconstruct_mesh_2 = DeconstructMesh(Mesh=onlybreps.A)  # -> Vertices, Faces, Colours, Normals
meshertree_3 = CSharpScript()  # -> simplify(meshOut); inputs points: tree of Point3d; same code as meshertree
