# Grasshopper definition FacadeIterations.gh (Grasshopper 0.9.76)
# plug-ins: Python Interpreter, Kangaroo Components, Weaverbird

number_slider = Slider(2, range=0..50)
number_slider_2 = Slider(2, range=0..10)
xz = XZPlane(Origin=Point(0, 0, 0))
square = Square(Plane=xz, Size=1, ExtentX=number_slider, ExtentY=number_slider_2)  # -> Cells, Points
addition = Addition(A=number_slider_2, B=number_slider)
subtraction = Subtraction(A=addition, B=number_slider_2)
points = PointList(Points=square.Points)
panel = Panel(square.Points)

# ---- group: SomeComponentsWeMightOrMightNotNeed
point = Point(square.Points)  # disabled
meshing = CSharpScript()  # -> Mesh; inputs points: list of Point3d; disabled
# ---------- meshing: C# ----------
    var mesh = new Mesh();

    mesh.Vertices.AddVertices(points);

    //for( int i = 0; i < 2; ++i )
    //{

      mesh.Faces.AddFace( 4, 1, 0 );

      mesh.Faces.AddFace( 4, 2, 1 );

      mesh.Faces.AddFace( 4, 2, 5 );
      
      mesh.Faces.AddFace( 4, 5, 8 );
    
      mesh.Faces.AddFace( 4, 8, 7 );
    
      mesh.Faces.AddFace( 4, 7, 6 );

      mesh.Faces.AddFace( 4, 6, 3 );
    
      mesh.Faces.AddFace( 4, 0, 3 );
    
    //}

    Mesh = mesh;
# ---------- end meshing ----------
boolean_toggle = BooleanToggle(True)  # disabled
c_script = CSharpScript(points=point)  # -> selectedPoints; inputs points: tree of Point3d; disabled
# ---------- c_script: C# ----------
    var pointsOut = new DataTree<Point3d>();

    int branches = points.BranchCount;

    for( int i = 0; i < branches; ++i )
    {

      var path = new GH_Path(i);

      for( int j = 0; j < points.Branch(i).Count; ++j )
      {


        if( i % 2 != 0 && j % 2 != 0 )

          pointsOut.Add(points.Branch(i)[j], path);


      }

    }

    selectedPoints = pointsOut;
# ---------- end c_script ----------
getmebranches = CSharpScript(tree=square.Points, clockWise=boolean_toggle)  # -> A; inputs tree: tree of Point3d, clockWise: Boolean; disabled
# ---------- getmebranches: C# ----------
    var linesOut = new DataTree<Point3d>();

    var branches = tree.BranchCount;

    int x = 0, y = 0;

    bool flag = clockWise;

    if( flag == true )
    {

      x = 0; y = 1;

    }

    if( flag == false )
    {

      x = 1; y = 0;

    }

    for( int i = 0; i < branches; ++i )
      for( int j = 0; j < tree.Branch(i).Count; ++j )
      {

        var path = new GH_Path(i);

        if( i % 2 != 0 && j % 2 != x )
          if( flag == true )

            linesOut.Add(tree.Branch(i)[j], path);

          else
          {

            linesOut.Add(tree.Branch(i)[j], path);

          }

        if( i % 2 != 1 && j % 2 != y )
          if( flag == true )

            linesOut.Add(tree.Branch(i)[j], path);

          else
          {

            linesOut.Add(tree.Branch(i)[j], path);

          }

      }

    A = linesOut;
# ---------- end getmebranches ----------
unit_z = UnitZ(Factor=1)  # disabled
number_slider_3 = Slider(1, range=0..1)  # disabled
move = Move(Geometry=c_script, Motion=unit_z)  # -> Geometry, Transform; disabled
point_list = PointList(Points=getmebranches, Size=number_slider_3)  # disabled
point_list_2 = PointList(Points=c_script, Size=number_slider_3)  # disabled

# ---- group: ThisAintThePrettiestButItGetsThingsDone
boolean_toggle_2 = BooleanToggle(False)
relative_item = RelativeItem(Tree=square.Points, Offset="{0;0;1}", WrapPaths=boolean_toggle_2, WrapItems=boolean_toggle_2)  # -> ItemA, ItemB
relative_item_2 = RelativeItem(Tree=square.Points, Offset="{0;0;0}[+1]", WrapPaths=boolean_toggle_2, WrapItems=boolean_toggle_2)  # -> ItemA, ItemB
relative_item_3 = RelativeItem(Tree=square.Points, Offset="{0;0;+1}[+1]", WrapPaths=boolean_toggle_2, WrapItems=boolean_toggle_2)  # -> ItemA, ItemB
relative_item_4 = RelativeItem(Tree=square.Points, Offset="{0;0;1}(-1)", WrapPaths=boolean_toggle_2, WrapItems=boolean_toggle_2)  # -> ItemA, ItemB

# ---- group: GiveMeThemLines
line = Line(StartPoint=relative_item_3.ItemA, EndPoint=relative_item_3.ItemB)  # -> simplify(Line)
line_2 = Line(StartPoint=relative_item_4.ItemA, EndPoint=relative_item_4.ItemB)  # -> simplify(Line)
line_3 = Line(StartPoint=relative_item_2.ItemA, EndPoint=relative_item_2.ItemB)  # -> simplify(Line)
line_4 = Line(StartPoint=relative_item.ItemA, EndPoint=relative_item.ItemB)  # -> simplify(Line)
c_script_2 = CSharpScript(lines=line_3)  # -> linesOut; inputs lines: tree of Line
# ---------- c_script_2: C# ----------
    int branches = lines.BranchCount;

    var newLines = new DataTree<Line>();
    
    var p = new int[branches];
    
    for( int i = 0; i < branches; ++i )
    {

      for( int j = 0; j < lines.Branch(i).Count; ++j )
      {

        if( i % 2 != 1 )
        {

          newLines.Add(lines.Branch(i)[j], new GH_Path(i/2));

        }
        
      }

    }

    linesOut = newLines;
# ---------- end c_script_2 ----------
getmebranches_2 = CSharpScript(tree=line, clockWise=Toggle(True))  # -> A; inputs tree: tree of Line, clockWise: Boolean
# ---------- getmebranches_2: C# ----------
    var linesOut = new DataTree<Line>();

    var branches = tree.BranchCount;

    int x = 0, y = 0;

    bool flag = clockWise;

    if( flag == true )
    {

      x = 0; y = 1;

    }

    if( flag == false )
    {

      x = 1; y = 0;

    }

    for( int i = 0; i < branches; ++i )
      for( int j = 0; j < tree.Branch(i).Count; ++j )
      {

        var path = new GH_Path(i);

        if( i % 2 != 0 && j % 2 != x )
          if( flag == true )

            linesOut.Add(tree.Branch(i)[j], path);

          else
          {

            linesOut.Add(tree.Branch(i)[j], path);

          }

        if( i % 2 != 1 && j % 2 != y )
          if( flag == true )

            linesOut.Add(tree.Branch(i)[j], path);

          else
          {

            linesOut.Add(tree.Branch(i)[j], path);

          }

      }

    A = linesOut;
# ---------- end getmebranches_2 ----------
getmebranches_3 = CSharpScript(tree=line_2, clockWise=Toggle(False))  # -> A; inputs tree: tree of Line, clockWise: Boolean; same code as getmebranches_2

# ---- group: GiveMeAMesh
line_5 = Line([line_4, getmebranches_2, getmebranches_3, c_script_2])
weaverbird_s_mesh_from_lines_weave_back = WeaverbirdsMeshFromLinesWeaveBack(Lines=flatten(line_5), MaximumValence=Slider(4, range=0..5))

# ---- group: AnchorPointsWeWantThemFixed
c_script_3 = CSharpScript(lines=line_3)  # -> linesOut; inputs lines: tree of Line
# ---------- c_script_3: C# ----------
    int branches = lines.BranchCount;

    var newLines = new DataTree<Line>();

    for( int i = 0; i < branches; ++i )
      for( int j = 0; j < lines.Branch(i).Count; ++j )
      {

        var path = new GH_Path(i);

        if( i % 2 != 0 )

          newLines.Add(lines.Branch(i)[j], path);

      }

    linesOut = newLines;
# ---------- end c_script_3 ----------
c_script_4 = CSharpScript(lines=line_4)  # -> linesOut; inputs lines: tree of Line
# ---------- c_script_4: C# ----------
    int branches = lines.BranchCount;

    var newLines = new DataTree<Line>();

    var p = new int[branches];

    for( int i = 0; i < branches; ++i )
    {

      for( int j = 0; j < lines.Branch(i).Count; ++j )
      {

        if( j % 2 != 1 )
        {

          newLines.Add(lines.Branch(i)[j], new GH_Path(j/2));

        }

      }

    }

    linesOut = newLines;
# ---------- end c_script_4 ----------
join = JoinCurves(Curves=c_script_3, Preserve=False)
join_2 = JoinCurves(Curves=c_script_4, Preserve=False)
join_3 = JoinCurves(Curves=c_script_2, Preserve=False)
end = EndPoints(Curve=join)  # -> Start, End
ccx = CurveCurve(CurveA=flatten(join_2), CurveB=join_3)  # -> flatten(Points), ParamsA, ParamsB
pt = Point(flatten([end.Start, end.End, ccx.Points]))

# ----
open_weather_file = Ladybug_OpenEPWWeatherFile(open=Toggle(True))  # -> epwFile; plug-in component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
ladybug = Ladybug_Ladybug()  # -> Vviiiiiiiiiizzz; plug-in component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
importepw = Ladybug_ImportEpw(epwFile=open_weather_file)  # -> readMe, latitude, location, dryBulbTemperature, dewPointTemperature, relativeHumidity, windSpeed, windDirection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; plug-in component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

# ---- group: OnePanelSimulation
panel_2 = Panel("-pi*0.5")
panel_3 = Panel("pi")
crv = Curve(flatten([getmebranches_2, getmebranches_3]))
crv_2 = Curve(flatten([line_4, c_script_2]))
multiplication = Multiplication(A=Slider(3.141592, range=0..3.141592), B=0.5)
origami = Origami(
    mesh=weaverbird_s_mesh_from_lines_weave_back,
    C=crv,
    num=Slider(100, range=0..100),
    num_5=panel_2,
    C_2=crv_2,
    num_3=panel_3,
    num_2=multiplication)  # -> data_2, R
timer = Timer(TimerInterval=20, Target=kangaroo)  # disabled
kangaroo = KangarooPhysics(ForceObjects=origami.data_2, AnchorPoints=pt, Settings=null, Geometry=origami.R, SimulationReset=Toggle(True))  # -> Out, Iterations, ParticlesOut, GeometryOut, KE
zombie = ZombieKangaroo(
    ForceObjects=origami.data_2,
    AnchorPoints=pt,
    Settings=null,
    Geometry=origami.R,
    Threshold=Slider(0.1, range=0..0.1),
    MaxIters=Slider(2000, range=0..10000))  # -> Out, Iterations, ParticlesOut, GeometryOut, KE

# ---- group: HorribleHackToGetDifferentPanels
addition_2 = Addition(A=subtraction, B=Slider(0.08106, range=0..1))
X = UnitX(Factor=addition_2)
move_2 = Move(Geometry=crv_2, Motion=X)  # -> Geometry, Transform
move_3 = Move(Geometry=pt, Motion=X)  # -> Geometry, Transform
move_4 = Move(Geometry=weaverbird_s_mesh_from_lines_weave_back, Motion=X)  # -> Geometry, Transform
mesh = Mesh(move_4.Geometry)
move_5 = Move(Geometry=crv, Motion=X)  # -> Geometry, Transform
multiplication_2 = Multiplication(A=Slider(3.141592, range=0..3.141592), B=0.5)
origami_2 = Origami(
    mesh=mesh,
    C=move_5.Geometry,
    num=Slider(100, range=0..100),
    num_5=panel_2,
    C_2=move_2.Geometry,
    num_3=panel_3,
    num_2=multiplication_2)  # -> data_2, R
lng = ListLength(List=origami_2.data_2)
lng_2 = ListLength(List=origami_2.R)
data = Data([origami.data_2, origami_2.data_2])
mesh_2 = Mesh([origami.R, origami_2.R])
pt_2 = Point([pt, move_3.Geometry])
timer_2 = Timer(TimerInterval=20, Target=kangaroophysics)  # disabled
kangaroophysics = KangarooPhysics(ForceObjects=data, AnchorPoints=pt_2, Settings=null, Geometry=mesh_2, SimulationReset=Toggle(True))  # -> Out, Iterations, ParticlesOut, GeometryOut, KE
zombie_2 = ZombieKangaroo(
    ForceObjects=data,
    AnchorPoints=pt_2,
    Settings=null,
    Geometry=mesh_2,
    Threshold=Slider(0.1, range=0..0.1),
    MaxIters=Slider(2000, range=0..10000))  # -> Out, Iterations, ParticlesOut, GeometryOut, KE

# ----
sunpath = Ladybug_SunPath(
    location=importepw.location,
    hour=Slider(12, range=0..100),
    day=Slider(31, range=0..100),
    month=Slider(12, range=0..100),
    timeStep=Slider(1, range=0..1),
    sunPathScale=Slider(0.1, range=0..0.1),
    dailyOrAnnualSunPath=True)  # -> readMe, sunVectors, sunAltitudes, sunAzimuths, port, sunSpheresMesh, sunPathCrvs, compassCrvs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; plug-in component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
mesh_3 = Mesh(zombie.GeometryOut)
pt_3 = Point(square.Points)
Y = UnitY(Factor=1)
c_script_5 = CSharpScript(points=pt_3)  # -> flatten(selectedPoints); inputs points: tree of Point3d; same code as c_script
medges = MeshEdges(Mesh=zombie.GeometryOut)  # -> NakedEdges, InteriorEdges, NonManifoldEdges
move_6 = Move(Geometry=c_script_5, Motion=X)  # -> Geometry, Transform
move_7 = Move(Geometry=c_script_5, Motion=Y)  # -> Geometry, Transform
pt_4 = Point(sunpath.sunPositions)
line_6 = Line(medges.InteriorEdges)
vec2pt = Vector2Pt(PointA=move_7.Geometry, PointB=c_script_5, Unitize=False)  # -> Vector, Length
eval = EvaluateCurve(Curve=line_6, Parameter=Slider(0, range=0..1))  # -> Point, Tangent, Angle
vdis = VectorDisplay(Anchor=c_script_5, Vector=vec2pt.Vector)
meshray = MeshRay(Mesh=mesh_3, Point=c_script_5, Direction=vec2pt.Vector)  # -> Point, Hit
cp = ClosestPoint(Point=meshray.Point, Cloud=eval.Point)  # -> ClosestPoint, CPIndex, Distance
lng_3 = ListLength(List=cp.ClosestPoint)
series = Series(Start=0, Step=1, Count=lng_3)
X_2 = UnitX(Factor=series)
move_8 = Move(Geometry=pt_4, Motion=X_2)  # -> Geometry, Transform
vec2pt_2 = Vector2Pt(PointA=pt_4, PointB=[cp.ClosestPoint, move_6.Geometry], Unitize=False)  # -> Vector, Length
vdis_2 = VectorDisplay(Anchor=pt_4, Vector=vec2pt_2.Vector)

# ==== cluster Origami: Fold a flat pattern into 3d origami
mesh = ClusterInput()
num = ClusterInput()
mesh_2 = Mesh(mesh)
num_2 = ClusterInput()
num_3 = ClusterInput()
hingepoints = HingePoints(Mesh=mesh_2)  # -> _1, _2, _3, _4
strength = Panel("1")
num_4 = Number(num_2)
C = ClusterInput()
C_2 = ClusterInput()
num_5 = ClusterInput()
num_6 = Number(num_3)
num_7 = Number(num)
eval = EvaluateCurve(Curve=reparameterize(C), Parameter=0.5)  # -> Point, Tangent, Angle
eval_2 = EvaluateCurve(Curve=reparameterize(C_2), Parameter=0.5)  # -> Point, Tangent, Angle
ln = Line(StartPoint=hingepoints._1, EndPoint=hingepoints._2)
num_8 = Number(num)
num_9 = Number(num_5)
tri = Triangulate(Mesh=mesh_2)  # -> Mesh, Count
multiplication = Multiplication(A=num_9, B=num_4)
multiplication_2 = Multiplication(A=num_6, B=num_4)
springsfrommesh = SpringsFromMesh(M=tri.Mesh, stiffness=100, B=1)
unweld = UnweldMesh(Mesh=mesh_2, Angle=0)
planarizequads = PlanarizeQuads(M=mesh_2, planarizestrength=1000)
eval_3 = EvaluateCurve(Curve=reparameterize(ln), Parameter=0.5)  # -> simplify(graft(Point)), Tangent, Angle
R = ClusterOutput(unweld)
cp = ClosestPoint(Point=eval_3.Point, Cloud=eval.Point)  # -> ClosestPoint, CPIndex, Distance
cp_2 = ClosestPoint(Point=eval_3.Point, Cloud=eval_2.Point)  # -> ClosestPoint, CPIndex, Distance
larger = LargerThan(FirstNumber=0.01, SecondNumber=cp_2.Distance)  # -> LargerThan, OrEqualTo
larger_2 = LargerThan(FirstNumber=0.01, SecondNumber=cp.Distance)  # -> LargerThan, OrEqualTo
cull = CullPattern(List=num_8, CullPattern=larger_2.LargerThan)
cull_2 = CullPattern(List=multiplication, CullPattern=larger_2.LargerThan)
cull_3 = CullPattern(List=num_7, CullPattern=larger.LargerThan)
cull_4 = CullPattern(List=multiplication_2, CullPattern=larger.LargerThan)
addition = Addition(A=cull, B=cull_3)
addition_2 = Addition(A=cull_2, B=cull_4)
addition_3 = Addition(A=0, B=addition)  # -> flatten(Result)
addition_4 = Addition(A=0, B=addition_2)  # -> flatten(Result)
panel = Panel(addition_2)
hinge = Hinge(
    Point1=simplify(hingepoints._1),
    Point2=simplify(hingepoints._2),
    Point3=simplify(hingepoints._3),
    Point4=simplify(hingepoints._4),
    Strength=addition_3,
    RestAngle=addition_4)
data = Data([springsfrommesh, hinge, planarizequads])
data_2 = ClusterOutput(data)
hinge_2 = Hinge(Strength=1)

# ==== cluster PlanarizeQuads: Applies a planarization force to any quads in a mesh
M = ClusterInput()
mcomp = Decompose(Mesh=M)  # -> Vertices, Faces, Colours, Normals
vertices = FaceVertices(Face=mcomp.Faces)  # -> CornerA, CornerB, CornerC, CornerD
planarizestrength = ClusterInput()
item = ListItem(List=mcomp.Vertices, Index=vertices.CornerA, Wrap=False)
item_2 = ListItem(List=mcomp.Vertices, Index=vertices.CornerB, Wrap=False)
item_3 = ListItem(List=mcomp.Vertices, Index=vertices.CornerC, Wrap=False)
item_4 = ListItem(List=mcomp.Vertices, Index=vertices.CornerD, Wrap=False)
planarize = Planarize(Point1=item, Point2=item_2, Point3=item_3, Point4=item_4, PlanarizeStrength=planarizestrength)
equals = Equality(FirstNumber=vertices.CornerC, SecondNumber=vertices.CornerD)  # -> Equality, Inequality
cull = CullPattern(List=planarize, CullPattern=equals.Inequality)
L = ClusterOutput(cull)

# ==== cluster SpringsFromMesh: Turns all edges of a mesh into springs
M = ClusterInput()
medges = MeshEdges(Mesh=M)  # -> NakedEdges, InteriorEdges, NonManifoldEdges
crv = Curve([medges.NakedEdges, medges.InteriorEdges])
B = ClusterInput()
len = Length(Curve=crv)
multiplication = Multiplication(A=len, B=B)
stiffness = ClusterInput()
springs = SpringsFromLine(Connection=crv, Stiffness=stiffness, Damping=10, RestLength=multiplication, UpperCutoff=0, LowerCutoff=0, Plasticity=0)
S = ClusterOutput(springs)
