# Grasshopper definition FacadeIterationsOne.gh (Grasshopper 0.9.76)
# plug-ins: Python Interpreter, Weaverbird, Kangaroo2 Components, TT Toolbox

xz = XZPlane(Origin=Point(0, 0, 0))
number_slider = Slider(1, range=0..50)
number_slider_2 = Slider(2, range=0..10)
xy_plane = XYPlane(Origin=Point(0, 0, 0))
number_slider_3 = Slider(2, range=0..50)
number_slider_4 = Slider(2, range=0..10)
xz_2 = XZPlane(Origin=Point(0, 0, 0))
xz_3 = XZPlane(Origin=Point(0, 0, 0))
hexagonal = Hexagonal(Plane=xy_plane, Size=Slider(1, range=0..1), ExtentX=number_slider, ExtentY=number_slider)  # -> Cells, Points
hexagonal_2 = Hexagonal(Plane=xz_2, Size=1, ExtentX=number_slider_3, ExtentY=number_slider_4)  # -> Cells, Points
hexagonal_3 = Hexagonal(Plane=xz_3, Size=1, ExtentX=Slider(2, range=0..50), ExtentY=Slider(2, range=0..10))  # -> Cells, Points
square = Square(Plane=xz_2, Size=1, ExtentX=number_slider_3, ExtentY=number_slider_4)  # -> Cells, Points

# ---- group: LadybugFly
toggle = BooleanToggle(True)  # disabled
open_weather_file = Ladybug_OpenEPWWeatherFile(open=toggle)  # -> epwFile; disabled; plug-in component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
ladybug = Ladybug_Ladybug()  # -> Vviiiiiiiiiizzz; disabled; plug-in component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
importepw = Ladybug_ImportEpw(epwFile=open_weather_file)  # -> readMe, latitude, location, dryBulbTemperature, dewPointTemperature, relativeHumidity, windSpeed, windDirection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; disabled; plug-in component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
number_slider_5 = Slider(0.1, range=0..0.1)  # disabled
number_slider_6 = Slider(12, range=0..100)  # disabled
number_slider_7 = Slider(31, range=0..100)  # disabled
number_slider_8 = Slider(12, range=0..100)  # disabled
number_slider_9 = Slider(1, range=0..1)  # disabled
sunpath = Ladybug_SunPath(
    location=importepw.location,
    hour=number_slider_6,
    day=number_slider_7,
    month=number_slider_8,
    timeStep=number_slider_9,
    sunPathScale=number_slider_5,
    dailyOrAnnualSunPath=True)  # -> readMe, sunVectors, sunAltitudes, sunAzimuths, port, sunSpheresMesh, sunPathCrvs, compassCrvs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; disabled; plug-in component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
mesh = Mesh()  # disabled
pt = Point(square.Points)  # disabled
Y = UnitY(Factor=1)  # disabled
c_script = CSharpScript(points=pt)  # -> flatten(selectedPoints); inputs points: tree of Point3d; disabled
# ---------- c_script: C# ----------
    var pointsOut = new DataTree<Point3d>();

    int branches = points.BranchCount;

    for( int i = 0; i < branches; ++i )
    {

      var path = new GH_Path(i);

      for( int j = 0; j < points.Branch(i).Count; ++j )
      {


        if( i % 2 != 0 && j % 2 != 0 )

          pointsOut.Add(points.Branch(i)[j], path);


      }

    }

    selectedPoints = pointsOut;
# ---------- end c_script ----------
medges = MeshEdges()  # -> NakedEdges, InteriorEdges, NonManifoldEdges; disabled
move = Move(Geometry=c_script, Motion=Vector(0, 0, 10))  # -> Geometry, Transform; disabled
move_2 = Move(Geometry=c_script, Motion=Y)  # -> Geometry, Transform; disabled
pt_2 = Point(sunpath.sunPositions)  # disabled
number_slider_10 = Slider(0, range=0..1)  # disabled
line = Line(medges.InteriorEdges)  # disabled
vec2pt = Vector2Pt(PointA=move_2.Geometry, PointB=c_script, Unitize=False)  # -> Vector, Length; disabled
eval = EvaluateCurve(Curve=line, Parameter=number_slider_10)  # -> Point, Tangent, Angle; disabled
vdis = VectorDisplay(Anchor=c_script, Vector=vec2pt.Vector)  # disabled
meshray = MeshRay(Mesh=mesh, Point=c_script, Direction=vec2pt.Vector)  # -> Point, Hit; disabled
cp = ClosestPoint(Point=meshray.Point, Cloud=eval.Point)  # -> ClosestPoint, CPIndex, Distance; disabled
lng = ListLength(List=cp.ClosestPoint)  # disabled
series = Series(Start=0, Step=1, Count=lng)  # disabled
X = UnitX(Factor=series)  # disabled
move_3 = Move(Geometry=pt_2, Motion=X)  # -> Geometry, Transform; disabled
vec2pt_2 = Vector2Pt(PointA=pt_2, PointB=[cp.ClosestPoint, move.Geometry], Unitize=False)  # -> Vector, Length; disabled
vdis_2 = VectorDisplay(Anchor=pt_2, Vector=vec2pt_2.Vector)  # disabled

# ----
addition = Addition(A=number_slider_4, B=number_slider_3)
point = Point(simplify(hexagonal.Points))
subtraction = Subtraction(A=addition, B=number_slider_4)
points = PointList(Points=square.Points)
panel = Panel(square.Points)

# ---- group: SomeComponentsWeMightOrMightNotNeed
point_2 = Point(square.Points)  # disabled
meshing = CSharpScript()  # -> Mesh; inputs points: list of Point3d; disabled
# ---------- meshing: C# ----------
    var mesh = new Mesh();

    mesh.Vertices.AddVertices(points);

    //for( int i = 0; i < 2; ++i )
    //{

      mesh.Faces.AddFace( 4, 1, 0 );

      mesh.Faces.AddFace( 4, 2, 1 );

      mesh.Faces.AddFace( 4, 2, 5 );
      
      mesh.Faces.AddFace( 4, 5, 8 );
    
      mesh.Faces.AddFace( 4, 8, 7 );
    
      mesh.Faces.AddFace( 4, 7, 6 );

      mesh.Faces.AddFace( 4, 6, 3 );
    
      mesh.Faces.AddFace( 4, 0, 3 );
    
    //}

    Mesh = mesh;
# ---------- end meshing ----------
boolean_toggle = BooleanToggle(True)  # disabled
c_script_2 = CSharpScript(points=point_2)  # -> selectedPoints; inputs points: tree of Point3d; disabled; same code as c_script
c_script_3 = CSharpScript(Reference="C:\Users\Paula\AppData\Roaming\Grasshopper\Libraries\KangarooSolver.dll")  # -> out, A, B; inputs x: list; disabled
# ---------- c_script_3: C# ----------
    
    var PS = new KangarooSolver.PhysicalSystem();
    double tol = 0.0001; // points closer than this will get combined into a single particle
    var GoalList = new List<IGoal>();

    //Assign indexes to the particles in each Goal:
    foreach(IGoal G in x)
    {
      PS.AssignPIndex(G, tol);
      GoalList.Add(G);
    }

    int counter = 0;
    double threshold = 1e-10;
    do
    {
      PS.Step(GoalList, false, threshold); // The step will iterate until either reaching 15ms or the energy threshold
      counter++;
    }while(PS.GetvSum() > threshold && counter < 100); //GetvSum returns the current kinetic energy
    // always include a counter to prevent it getting stuck forever in case it cannot reach the given threshold

    A = PS.GetOutput(GoalList);
    B = counter;
# ---------- end c_script_3 ----------
getmebranches = CSharpScript(tree=square.Points, clockWise=boolean_toggle)  # -> A; inputs tree: tree of Point3d, clockWise: Boolean; disabled
# ---------- getmebranches: C# ----------
    var linesOut = new DataTree<Point3d>();

    var branches = tree.BranchCount;

    int x = 0, y = 0;

    bool flag = clockWise;

    if( flag == true )
    {

      x = 0; y = 1;

    }

    if( flag == false )
    {

      x = 1; y = 0;

    }

    for( int i = 0; i < branches; ++i )
      for( int j = 0; j < tree.Branch(i).Count; ++j )
      {

        var path = new GH_Path(i);

        if( i % 2 != 0 && j % 2 != x )
          if( flag == true )

            linesOut.Add(tree.Branch(i)[j], path);

          else
          {

            linesOut.Add(tree.Branch(i)[j], path);

          }

        if( i % 2 != 1 && j % 2 != y )
          if( flag == true )

            linesOut.Add(tree.Branch(i)[j], path);

          else
          {

            linesOut.Add(tree.Branch(i)[j], path);

          }

      }

    A = linesOut;
# ---------- end getmebranches ----------
unit_z = UnitZ(Factor=1)  # disabled
number_slider_11 = Slider(1, range=0..1)  # disabled
move_4 = Move(Geometry=c_script_2, Motion=unit_z)  # -> Geometry, Transform; disabled
# You can replace the mesh with a different
# pattern, and choose edges from it to assign
# to mountain or valley folds.
point_list = PointList(Points=getmebranches, Size=number_slider_11)  # disabled
point_list_2 = PointList(Points=c_script_2, Size=number_slider_11)  # disabled

# ----
c_script_4 = CSharpScript(point=point, direction=Slider(2, range=0..10))  # -> graft(A), B; inputs point: tree of Point3d, direction: Int32
# ---------- c_script_4: C# ----------
    var vectorDir = new Point3d(0, 0, 0);

    if( direction > direction % 3 ) direction = direction % 3;

    switch( direction )
    {

      case 0: vectorDir = new Point3d(1, 0, 0);
        break;

      case 1: vectorDir = new Point3d(0, 1, 0);
        break;

      case 2: vectorDir = new Point3d(0, 0, 1);
        break;

    }

    var dataTreeOut = new DataTree<Plane>();
    var counter = 0;
    
    for( int i = 0; i < point.BranchCount; ++i )
      for( int j = 0; j < point.Branch(i).Count; ++j )
      {

        dataTreeOut.Add(new Plane(point.Branch(i)[j], new Vector3d(vectorDir)), new GH_Path(0));
        dataTreeOut.Graft( new GH_Path( counter ), true );
        
      }

    A = dataTreeOut;

    B = direction;
# ---------- end c_script_4 ----------

# ---- group: ThisAintThePrettiestButItGetsThingsDone
boolean_toggle_2 = BooleanToggle(False)
relative_item = RelativeItem(Tree=square.Points, Offset="{0;0;1}", WrapPaths=boolean_toggle_2, WrapItems=boolean_toggle_2)  # -> ItemA, ItemB
relative_item_2 = RelativeItem(Tree=square.Points, Offset="{0;0;0}[+1]", WrapPaths=boolean_toggle_2, WrapItems=boolean_toggle_2)  # -> ItemA, ItemB
relative_item_3 = RelativeItem(Tree=square.Points, Offset="{0;0;+1}[+1]", WrapPaths=boolean_toggle_2, WrapItems=boolean_toggle_2)  # -> ItemA, ItemB
relative_item_4 = RelativeItem(Tree=square.Points, Offset="{0;0;1}(-1)", WrapPaths=boolean_toggle_2, WrapItems=boolean_toggle_2)  # -> ItemA, ItemB

# ----
polygon = Polygon(Plane=c_script_4.A, Radius=Slider(0.863135, range=0..1), Segments=Slider(6, range=0..100), FilletRadius=0)  # -> Polygon, Length
radians = Radians(Degrees=Slider(0, range=0..1000))
rotate = Rotate(Geometry=polygon.Polygon, Angle=radians, Plane=c_script_4.A)  # -> simplify(Geometry), Transform
discontinuity = Discontinuity(Curve=rotate.Geometry, Level=1)  # -> simplify(Points), Parameters

# ---- group: GiveMeThemLines
line_2 = Line(StartPoint=relative_item_3.ItemA, EndPoint=relative_item_3.ItemB)  # -> simplify(Line)
line_3 = Line(StartPoint=relative_item_4.ItemA, EndPoint=relative_item_4.ItemB)  # -> simplify(Line)
line_4 = Line(StartPoint=relative_item_2.ItemA, EndPoint=relative_item_2.ItemB)  # -> simplify(Line)
line_5 = Line(StartPoint=relative_item.ItemA, EndPoint=relative_item.ItemB)  # -> simplify(Line)
c_script_5 = CSharpScript(lines=line_4)  # -> linesOut; inputs lines: tree of Line
# ---------- c_script_5: C# ----------
    int branches = lines.BranchCount;

    var newLines = new DataTree<Line>();
    
    var p = new int[branches];
    
    for( int i = 0; i < branches; ++i )
    {

      for( int j = 0; j < lines.Branch(i).Count; ++j )
      {

        if( i % 2 != 1 )
        {

          newLines.Add(lines.Branch(i)[j], new GH_Path(i/2));

        }
        
      }

    }

    linesOut = newLines;
# ---------- end c_script_5 ----------
getmebranches_2 = CSharpScript(tree=line_2, clockWise=Toggle(True))  # -> A; inputs tree: tree of Line, clockWise: Boolean
# ---------- getmebranches_2: C# ----------
    var linesOut = new DataTree<Line>();

    var branches = tree.BranchCount;

    int x = 0, y = 0;

    bool flag = clockWise;

    if( flag == true )
    {

      x = 0; y = 1;

    }

    if( flag == false )
    {

      x = 1; y = 0;

    }

    for( int i = 0; i < branches; ++i )
      for( int j = 0; j < tree.Branch(i).Count; ++j )
      {

        var path = new GH_Path(i);

        if( i % 2 != 0 && j % 2 != x )
          if( flag == true )

            linesOut.Add(tree.Branch(i)[j], path);

          else
          {

            linesOut.Add(tree.Branch(i)[j], path);

          }

        if( i % 2 != 1 && j % 2 != y )
          if( flag == true )

            linesOut.Add(tree.Branch(i)[j], path);

          else
          {

            linesOut.Add(tree.Branch(i)[j], path);

          }

      }

    A = linesOut;
# ---------- end getmebranches_2 ----------
getmebranches_3 = CSharpScript(tree=line_3, clockWise=Toggle(False))  # -> A; inputs tree: tree of Line, clockWise: Boolean; same code as getmebranches_2

# ----
line_6 = Line(StartPoint=graft(point), EndPoint=discontinuity.Points)
shatter = Shatter(Curve=rotate.Geometry, Parameters=discontinuity.Parameters)
evaluate_curve = EvaluateCurve(Curve=reparameterize(shatter), Parameter=Slider(0.5, range=0..1))  # -> Point, Tangent, Angle
c_script_6 = CSharpScript(points=evaluate_curve.Point)  # -> selectedPoints; inputs points: list of Point3d
# ---------- c_script_6: C# ----------
    var pointsOut = new List<Point3d>();

    int size = points.Count;

    for( int i = 0; i < size; ++i )
    {
        if( i % 2 != 1 )

          pointsOut.Add( points[i] );

    }

    selectedPoints = pointsOut;
# ---------- end c_script_6 ----------

# ---- group: GiveMeAMesh
line_7 = Line([line_5, getmebranches_2, getmebranches_3, c_script_5])
weaverbird_s_mesh_from_lines_weave_back = WeaverbirdsMeshFromLinesWeaveBack(Lines=flatten(line_7), MaximumValence=Slider(4, range=0..5))

# ----
line_8 = Line(StartPoint=graft(point), EndPoint=c_script_6)
discontinuity_2 = Discontinuity(Curve=shatter, Level=1)  # -> Points, Parameters
line_9 = Line([shatter, line_6, line_8])
discontinuity_3 = Discontinuity(Curve=line_9, Level=1)  # -> Points, Parameters

# ---- group: AnchorPointsWeWantThemFixed
c_script_7 = CSharpScript(lines=line_4)  # -> linesOut; inputs lines: tree of Line
# ---------- c_script_7: C# ----------
    int branches = lines.BranchCount;

    var newLines = new DataTree<Line>();

    for( int i = 0; i < branches; ++i )
      for( int j = 0; j < lines.Branch(i).Count; ++j )
      {

        var path = new GH_Path(i);

        if( i % 2 != 0 )

          newLines.Add(lines.Branch(i)[j], path);

      }

    linesOut = newLines;
# ---------- end c_script_7 ----------
c_script_8 = CSharpScript(lines=line_5)  # -> linesOut; inputs lines: tree of Line
# ---------- c_script_8: C# ----------
    int branches = lines.BranchCount;

    var newLines = new DataTree<Line>();

    var p = new int[branches];

    for( int i = 0; i < branches; ++i )
    {

      for( int j = 0; j < lines.Branch(i).Count; ++j )
      {

        if( j % 2 != 1 )
        {

          newLines.Add(lines.Branch(i)[j], new GH_Path(j/2));

        }

      }

    }

    linesOut = newLines;
# ---------- end c_script_8 ----------
join = JoinCurves(Curves=c_script_7, Preserve=False)
join_2 = JoinCurves(Curves=c_script_8, Preserve=False)
join_3 = JoinCurves(Curves=c_script_5, Preserve=False)
end = EndPoints(Curve=join)  # -> Start, End
ccx = CurveCurve(CurveA=flatten(join_2), CurveB=join_3)  # -> flatten(Points), ParamsA, ParamsB
pt_3 = Point(flatten([end.Start, end.End, ccx.Points]))

# ----
point_3 = Point(discontinuity_2.Points)
remove_duplicate_points = RemoveDuplicatePoints(InputPoints=flatten(point_3), Tolerance=0.001)  # -> OutputPoints, FirstPointIndexes
weaverbird_s_mesh_from_lines_weave_back_2 = WeaverbirdsMeshFromLinesWeaveBack(Lines=flatten(line_9), MaximumValence=Slider(5, range=0..5))

# ---- group: AnchorPointsWeWantThemFixed
c_script_9 = CSharpScript(lines=line_8)  # -> linesOut; inputs lines: tree of Line; same code as c_script_7
c_script_10 = CSharpScript(lines=shatter)  # -> linesOut; inputs lines: tree of Line; same code as c_script_8
join_4 = JoinCurves(Curves=c_script_9, Preserve=False)
join_5 = JoinCurves(Curves=c_script_10, Preserve=False)
join_6 = JoinCurves(Curves=c_script_5, Preserve=False)
end_2 = EndPoints(Curve=join_4)  # -> Start, End
ccx_2 = CurveCurve(CurveA=flatten(join_5), CurveB=join_6)  # -> flatten(Points), ParamsA, ParamsB
pt_4 = Point(flatten([end_2.Start, end_2.End, ccx_2.Points]))

# ----
clean_tree = CleanTree(RemoveNulls=True, RemoveInvalid=True, RemoveEmpty=False, Tree=remove_duplicate_points.OutputPoints)
point_4 = Point(flatten([clean_tree, c_script_6]))
sort_points = SortPoints(Points=point_4)  # -> Points, Indices
addition_2 = Addition(A=subtraction, B=Slider(0.08106, range=0..1))
delaunay_mesh = DelaunayMesh(Points=flatten([clean_tree, c_script_6]), Plane=PlaneXY(0, 0, 0))
X_2 = UnitX(Factor=addition_2)
crv = Curve([getmebranches_2, getmebranches_3])
point_list_3 = PointList(Points=sort_points.Points, Size=Slider(0.2, range=0..1))
move_5 = Move(Geometry=crv, Motion=X_2)  # -> Geometry, Transform
crv_2 = Curve([line_5, c_script_5])
move_6 = Move(Geometry=crv_2, Motion=X_2)  # -> Geometry, Transform
# To start, Press the 'Reset' button below  then slowly change the 'Folding' slider.
move_7 = Move(Geometry=weaverbird_s_mesh_from_lines_weave_back, Motion=X_2)  # -> Geometry, Transform
folding = Slider(0.99, range=0..0.99)
folding_2 = Slider(0.614, range=0..0.99)

# ---- group: mesh of flat folding pattern
mesh_2 = Mesh(simplify(graft([weaverbird_s_mesh_from_lines_weave_back, move_7.Geometry])))

# ---- group: Mountain fold lines
crv_3 = Curve([crv, move_5.Geometry])

# ----
angle = Panel("pi")
angle_2 = Panel("-pi")

# ---- group: Valley fold lines
crv_4 = Curve([crv_2, move_6.Geometry])

# ----
folding_3 = Slider(0, range=0..0.99)
multiplication = Multiplication(A=angle, B=folding)
multiplication_2 = Multiplication(A=angle_2, B=folding)

multiplication_3 = Multiplication(A=angle, B=folding_2)
hingepoints = HingePoints(Mesh=mesh_2)  # -> _1, _2, _3, _4
multiplication_4 = Multiplication(A=angle_2, B=folding_2)
ln = Line(StartPoint=hingepoints._1, EndPoint=hingepoints._2)
hinge = Hinge(
    FoldStart=hingepoints._1,
    FoldEnd=hingepoints._2,
    Tip1=hingepoints._3,
    Tip2=hingepoints._4,
    RestAngle=simplify(graft([multiplication_3, multiplication])),
    Strength=0.1)
hinge_2 = Hinge(
    FoldStart=hingepoints._1,
    FoldEnd=hingepoints._2,
    Tip1=hingepoints._3,
    Tip2=hingepoints._4,
    RestAngle=simplify(graft([multiplication_4, multiplication_2])),
    Strength=0.1)
show = Show(G=mesh_2)
eval_2 = EvaluateCurve(Curve=reparameterize(crv_4), Parameter=0.5)  # -> Point, Tangent, Angle
eval_3 = EvaluateCurve(Curve=reparameterize(crv_3), Parameter=0.5)  # -> Point, Tangent, Angle
eval_4 = EvaluateCurve(Curve=ln, Parameter=0.5)  # -> graft(Point), Tangent, Angle
dist = Distance(PointA=eval_2.Point, PointB=eval_4.Point)
dist_2 = Distance(PointA=eval_3.Point, PointB=eval_4.Point)
sort = SortList(Keys=dist)  # -> Keys, ValuesA
sort_2 = SortList(Keys=dist_2)  # -> Keys, ValuesA
item = ListItem(List=sort.Keys, Index=0, Wrap=True)
item_2 = ListItem(List=sort_2.Keys, Index=0, Wrap=True)
smaller = SmallerThan(FirstNumber=item, SecondNumber=0.01)  # -> flatten(SmallerThan), OrEqualTo
smaller_2 = SmallerThan(FirstNumber=item_2, SecondNumber=0.01)  # -> flatten(SmallerThan), OrEqualTo
cull = CullPattern(List=hinge, CullPattern=smaller_2.SmallerThan)
cull_2 = CullPattern(List=hinge_2, CullPattern=smaller.SmallerThan)

mesh_3 = Mesh(simplify(graft(delaunay_mesh)))
crv_5 = Curve(line_6)
angle_3 = Panel("pi")
angle_4 = Panel("-pi")
crv_6 = Curve([line_8, shatter])

# ---- group: maintain edge lengths
medges_2 = MeshEdges(Mesh=mesh_2)  # -> NakedEdges, InteriorEdges, NonManifoldEdges
length_line = LengthLine(Line=[medges_2.NakedEdges, medges_2.InteriorEdges], Strength=1)

# ---- group: a weak plastic anchor on all points prevents drift
demesh = DeconstructMesh(Mesh=mesh_2)  # -> Vertices, Faces, Colours, Normals
plasticanchor = PlasticAnchor(Point=demesh.Vertices, Limit=0.01, Strength=0.001)

# ----
hingepoints_2 = HingePoints(Mesh=mesh_3)  # -> _1, _2, _3, _4
multiplication_5 = Multiplication(A=angle_4, B=folding_3)
ln_2 = Line(StartPoint=hingepoints_2._1, EndPoint=hingepoints_2._2)
medges_3 = MeshEdges(Mesh=mesh_3)  # -> NakedEdges, InteriorEdges, NonManifoldEdges
demesh_2 = DeconstructMesh(Mesh=mesh_3)  # -> Vertices, Faces, Colours, Normals
hinge_3 = Hinge(
    FoldStart=hingepoints_2._1,
    FoldEnd=hingepoints_2._2,
    Tip1=hingepoints_2._3,
    Tip2=hingepoints_2._4,
    RestAngle=simplify(graft(multiplication_5)),
    Strength=0.1)
hinge_4 = Hinge(
    FoldStart=hingepoints_2._1,
    FoldEnd=hingepoints_2._2,
    Tip1=hingepoints_2._3,
    Tip2=hingepoints_2._4,
    RestAngle=simplify(graft(multiplication_5)),
    Strength=0.1)
show_2 = Show(G=mesh_3)
eval_5 = EvaluateCurve(Curve=reparameterize(crv_6), Parameter=0.5)  # -> Point, Tangent, Angle
eval_6 = EvaluateCurve(Curve=reparameterize(crv_5), Parameter=0.5)  # -> Point, Tangent, Angle
eval_7 = EvaluateCurve(Curve=ln_2, Parameter=0.5)  # -> graft(Point), Tangent, Angle
plasticanchor_2 = PlasticAnchor(Point=demesh_2.Vertices, Limit=0.01, Strength=0.001)
length_line_2 = LengthLine(Line=[medges_3.NakedEdges, medges_3.InteriorEdges], Strength=1)
dist_3 = Distance(PointA=eval_5.Point, PointB=eval_7.Point)
dist_4 = Distance(PointA=eval_6.Point, PointB=eval_7.Point)
sort_3 = SortList(Keys=dist_3)  # -> Keys, ValuesA
sort_4 = SortList(Keys=dist_4)  # -> Keys, ValuesA
move_8 = Move(Geometry=pt_3, Motion=X_2)  # -> Geometry, Transform
reset = Button()
item_3 = ListItem(List=sort_3.Keys, Index=0, Wrap=True)
anchor = Anchor(Point=[pt_3, move_8.Geometry], Strength=10000)
item_4 = ListItem(List=sort_4.Keys, Index=0, Wrap=True)
smaller_3 = SmallerThan(FirstNumber=item_3, SecondNumber=0.01)  # -> flatten(SmallerThan), OrEqualTo
data = Data([length_line, cull_2, cull, show, plasticanchor, anchor])
smaller_4 = SmallerThan(FirstNumber=item_4, SecondNumber=0.01)  # -> flatten(SmallerThan), OrEqualTo
solver = Solver(GoalObjects=flatten(data), Reset=reset, Threshold=1e-15, Tolerance=0.01, On=Toggle(True))  # -> I, V, O
cull_3 = CullPattern(List=hinge_3, CullPattern=smaller_4.SmallerThan)
cull_4 = CullPattern(List=hinge_4, CullPattern=smaller_3.SmallerThan)
reset_2 = Button()
data_2 = Data([length_line_2, cull_4, cull_3, show_2, plasticanchor_2])
solver_2 = Solver(GoalObjects=data_2, Reset=reset_2, Threshold=1e-15, Tolerance=0.01, On=Toggle(True))  # -> I, V, O
