# Grasshopper definition FacadeIterationsTwo.gh (Grasshopper 0.9.76)
# plug-ins: Python Interpreter, Weaverbird, Kangaroo2 Components

number_slider = Slider(1, range=0..10)
number_slider_2 = Slider(10, range=0..10)
number_slider_3 = Slider(32, range=0..200)
xy = XYPlane(Origin=Point(0, 0, 0))
xz = XZPlane(Origin=Point(0, 0, 0))
hexagonal = Hexagonal(Plane=xz, Size=Slider(1, range=0..1), ExtentX=number_slider, ExtentY=number_slider)  # -> Cells, simplify(Points)
hexagonal_2 = Hexagonal(Plane=xz, Size=Slider(0.3, range=0..1), ExtentX=number_slider_3, ExtentY=number_slider_3)  # -> Cells, simplify(Points)
discontinuity = Discontinuity(Curve=hexagonal.Cells, Level=1)  # -> Points, Parameters
shatter = Shatter(Curve=hexagonal.Cells, Parameters=discontinuity.Parameters)
simplifybranches = CSharpScript(points=hexagonal.Points)  # -> pointsOut; inputs points: tree of Point3d
# ---------- simplifybranches: C# ----------
    int size = points.BranchCount;
    
    var finalPoints = new DataTree<Point3d>();
    
    for( int i = 0; i < size; ++i )
      for( int j = 0; j < points.Branch(i).Count; ++j )
      {
      
        finalPoints.Add( points.Branch(i)[j], new GH_Path(i) );
      
      }
    
    pointsOut = finalPoints;
# ---------- end simplifybranches ----------
simplifybranches_2 = CSharpScript(points=hexagonal_2.Points)  # -> pointsOut; inputs points: tree of Point3d; same code as simplifybranches
flatten = FlattenTree(Tree=hexagonal.Cells, Path="{0}")
point = Point(simplify(flatten(simplifybranches)))
evaluate_curve = EvaluateCurve(Curve=reparameterize(shatter), Parameter=Slider(0.5, range=0..1))  # -> Point, Tangent, Angle
point_list = PointList(Points=discontinuity.Points, Size=Slider(0.192, range=0..1))
graft = GraftTree(Tree=point, IncludeEmptyLists=True, IncludeNullItems=True)  # -> simplify(Tree)
panel = Panel("""1
4""")
list_item = ListItem(List=discontinuity.Points, Index=0, Wrap=True)
list_item_2 = ListItem(List=discontinuity.Points, Index=Slider(3, range=0..10), Wrap=True)
c_script = CSharpScript(point=graft, direction=Slider(4, range=0..10))  # -> simplify(A); inputs point: tree of Point3d, direction: Int32
# ---------- c_script: C# ----------
    var vectorDir = new Point3d(0, 0, 0);

    if( direction > direction % 3 ) direction = direction % 3;

    switch( direction )
    {

      case 0: vectorDir = new Point3d(1, 0, 0);
        break;

      case 1: vectorDir = new Point3d(0, 1, 0);
        break;

      case 2: vectorDir = new Point3d(0, 0, 1);
        break;

    }

    var dataTreeOut = new DataTree<Plane>();

    for( int i = 0; i < point.BranchCount; ++i )
      for( int j = 0; j < point.Branch(i).Count; ++j )
      {

        dataTreeOut.Add(new Plane(point.Branch(i)[j], new Vector3d(vectorDir)), new GH_Path(i));
        //dataTreeOut.Graft(new GH_Path(counter), true);

      }

    A = dataTreeOut;
# ---------- end c_script ----------
cull_index = CullIndex(List=evaluate_curve.Point, Indices=panel, Wrap=True)
line = Line(StartPoint=list_item, EndPoint=list_item_2)
list_item_3 = ListItem(List=discontinuity.Points, Index=Slider(1, range=0..1), Wrap=True)
list_item_4 = ListItem(List=discontinuity.Points, Index=Slider(0, range=0..5), Wrap=True)
list_item_5 = ListItem(List=discontinuity.Points, Index=Slider(2, range=0..5), Wrap=True)
list_item_6 = ListItem(List=discontinuity.Points, Index=Slider(3, range=0..5), Wrap=True)
list_item_7 = ListItem(List=discontinuity.Points, Index=Slider(4, range=0..5), Wrap=True)
list_item_8 = ListItem(List=discontinuity.Points, Index=Slider(5, range=0..5), Wrap=True)
polygon = Polygon(Plane=c_script, Radius=Slider(0.98, range=0..1), Segments=Slider(6, range=0..100), FilletRadius=0)  # -> Polygon, Length
divide_curve = DivideCurve(Curve=line, Count=Slider(3, range=0..10), Kinks=False)  # -> Points, Tangents, Parameters
radians = Radians(Degrees=Slider(0, range=0..1000))
rotate = Rotate(Geometry=polygon.Polygon, Angle=1.570796327, Plane=c_script)  # -> simplify(Geometry), Transform
list_item_9 = ListItem(List=divide_curve.Points, Index=Slider(1, range=0..3), Wrap=True)
list_item_10 = ListItem(List=divide_curve.Points, Index=Slider(2, range=0..3), Wrap=True)
simplifybranches_3 = CSharpScript(points=flatten([list_item_9, list_item_10, discontinuity.Points, cull_index]))  # -> pointsOut; inputs points: tree of Point3d; same code as simplifybranches
simplifybranches_4 = CSharpScript(points=flatten([list_item_9, list_item_10, discontinuity.Points, cull_index, simplifybranches]))  # -> pointsOut; inputs points: tree of Point3d; same code as simplifybranches
number_slider_4 = Slider(10, range=0..10)  # disabled
delaunay_mesh = DelaunayMesh(Points=simplifybranches_4, Plane=xz)
discontinuity_2 = Discontinuity(Curve=simplify(rotate.Geometry), Level=1)  # -> simplify(Points), simplify(Parameters)
folding = Slider(0, range=0..2.7)
area = Area(Geometry=rotate.Geometry)  # -> Area, Centroid
meshertree = CSharpScript(points=simplifybranches_3)  # -> simplify(graft(meshOut)); inputs points: tree of Point3d
# ---------- meshertree: C# ----------
    int size = points.BranchCount;

    var mesh = new Mesh[size];

    var organized = new Point3d[size][];

    for( int i = 0; i < size; ++i )
    {

      mesh[i] = new Mesh();
      mesh[i].Vertices.AddVertices(points.Branch(i));

      mesh[i].Faces.AddFace(6, 5, 0);
      mesh[i].Faces.AddFace(6, 1, 0);
      mesh[i].Faces.AddFace(6, 7, 2, 1);
      mesh[i].Faces.AddFace(6, 5, 4, 7);
      mesh[i].Faces.AddFace(3, 4, 7);
      mesh[i].Faces.AddFace(2, 3, 7);

    }

    meshOut = mesh;
# ---------- end meshertree ----------
singlemesh = CSharpScript(points=simplifybranches_3)  # -> meshOut, A; inputs points: list of Point3d
# ---------- singlemesh: C# ----------
    var mesh = new Mesh();

    int size = points.Count;

    mesh.Vertices.AddVertices(points);

    //mesh.Faces.AddFace(6, 7, 2, 1);
    mesh.Faces.AddFace(6, 1, 8);
    mesh.Faces.AddFace(6, 0, 8);
    mesh.Faces.AddFace(6, 5, 11);
    mesh.Faces.AddFace(6, 0, 11);
    mesh.Faces.AddFace(7, 2, 9);
    mesh.Faces.AddFace(7, 3, 9);
    mesh.Faces.AddFace(7, 3, 10);
    mesh.Faces.AddFace(7, 4, 10); 
    /*
    mesh.Faces.AddFace(6, 7, 2, 1);
    mesh.Faces.AddFace(6, 1, 8);
    mesh.Faces.AddFace(6, 0, 8);
    mesh.Faces.AddFace(6, 0, 11);
    mesh.Faces.AddFace(6, 11, 5);
    mesh.Faces.AddFace(6, 7, 4, 5);
    mesh.Faces.AddFace(7, 2, 9);
    mesh.Faces.AddFace(7, 3, 9);
    mesh.Faces.AddFace(7, 3, 10);
    mesh.Faces.AddFace(7, 4, 10);
    */
  
    meshOut = mesh;

    A = points;
# ---------- end singlemesh ----------
points = PointList(Points=singlemesh.A, Size=Slider(0.1407, range=0..1))
line_2 = Line(StartPoint=list_item_3, EndPoint=list_item_9)
line_3 = Line(StartPoint=list_item_8, EndPoint=list_item_9)
line_4 = Line(StartPoint=list_item_7, EndPoint=list_item_10)
line_5 = Line(StartPoint=list_item_5, EndPoint=list_item_10)
line_6 = Line(StartPoint=list_item_9, EndPoint=list_item_10)
line_7 = Line(StartPoint=list_item_6, EndPoint=list_item_10)
line_8 = Line(StartPoint=list_item_4, EndPoint=list_item_9)
point_list_2 = PointList(Points=simplifybranches_3, Size=Slider(0.192, range=0..1))
branchrearrange = CSharpScript(points=discontinuity_2.Points)  # -> A; inputs points: tree of Point3d
# ---------- branchrearrange: C# ----------
    var pointsOut = new DataTree<Point3d>();

    for( int i = 0; i < points.BranchCount; ++i )
      for( int j = 0; j < points.Branch(i).Count; ++j )
      {

        pointsOut.Add(points.Branch(i)[j], new GH_Path(i));

      }

    A = pointsOut;
# ---------- end branchrearrange ----------
line_9 = Line(StartPoint=graft(point), EndPoint=branchrearrange)  # -> simplify(Line)
point_2 = Point([discontinuity.Points, list_item_9, list_item_10])
shatter_2 = Shatter(Curve=rotate.Geometry, Parameters=discontinuity_2.Parameters)  # -> simplify(Segments)
branchrearrange_2 = CSharpScript(lines=line_9)  # -> A; inputs lines: tree of Line
# ---------- branchrearrange_2: C# ----------
    var linesOut = new DataTree<Line>();
    
    for( int i = 0; i < lines.BranchCount; ++i )
      for( int j = 0; j < lines.Branch(i).Count; ++j )
      {
      
        linesOut.Add( lines.Branch(i)[j], new GH_Path(i) );
      
      }
    
    A = linesOut;
# ---------- end branchrearrange_2 ----------
mesh = Mesh(flatten(delaunay_mesh))
crv = Curve([<curve referenced from the Rhino model> x4])
crv_2 = Curve(flatten([<curve referenced from the Rhino model> x2]))
line_10 = Line(flatten([line_5, line_4, line_3, line_2, line_6, line_7, line_8]))
folding_2 = Slider(0, range=0..8)
branchrearrange_3 = CSharpScript(lines=shatter_2)  # -> A; inputs lines: tree of Line; same code as branchrearrange_2
meshertree_2 = CSharpScript(points=simplifybranches_3)  # -> simplify(graft(meshOut)); inputs points: tree of Point3d; same code as meshertree
hingepoints = HingePoints(Mesh=mesh)  # -> _1, _2, _3, _4
ln = Line(StartPoint=hingepoints._1, EndPoint=hingepoints._2)  # -> simplify(Line)
medges = MeshEdges(Mesh=mesh)  # -> simplify(NakedEdges), simplify(InteriorEdges), simplify(NonManifoldEdges)
demesh = DeconstructMesh(Mesh=mesh)  # -> simplify(Vertices), Faces, Colours, Normals
join = JoinCurves(Curves=branchrearrange_3, Preserve=False)
eval = EvaluateCurve(Curve=simplify(flatten(ln)), Parameter=0.5)  # -> graft(Point), Tangent, Angle
evaluate_curve_2 = EvaluateCurve(Curve=reparameterize(branchrearrange_3), Parameter=Slider(0.5, range=0..1))  # -> Point, Tangent, Angle
show = Show(G=mesh)
eval_2 = EvaluateCurve(Curve=reparameterize(crv_2), Parameter=0.5)  # -> Point, Tangent, Angle
eval_3 = EvaluateCurve(Curve=reparameterize(crv), Parameter=0.5)  # -> Point, Tangent, Angle
panel_2 = Panel(meshertree_2)
plasticanchor = PlasticAnchor(Point=demesh.Vertices, Limit=0.01, Strength=0.001)
brep = Brep(join)
length_line = LengthLine(Line=[medges.NakedEdges, medges.InteriorEdges], Strength=1)
dist = Distance(PointA=eval_2.Point, PointB=eval.Point)
dist_2 = Distance(PointA=eval_3.Point, PointB=eval.Point)
c_script_2 = CSharpScript(points=evaluate_curve_2.Point)  # -> selectedPoints; inputs points: list of Point3d
# ---------- c_script_2: C# ----------
    var pointsOut = new List<Point3d>();

    int size = points.Count;

    for( int i = 0; i < size; ++i )
    {
      if( i % 5 != 0 )

        //if( i % 3 != 0 )
        
        pointsOut.Add(points[i]);

    }

    selectedPoints = pointsOut;
# ---------- end c_script_2 ----------
c_script_3 = CSharpScript(points=area.Centroid)  # -> selectedPoints; inputs points: tree of Point3d
# ---------- c_script_3: C# ----------
    var pointsOut = new DataTree<Point3d>();

    int size = points.BranchCount;

    for( int i = 0; i < size; ++i )
    {

      for( int j = 0; j < points.Branch(i).Count; ++j )

        //if( i % size != 0 )

          pointsOut.Add(points.Branch(i)[j], new GH_Path(i));

    }

    selectedPoints = pointsOut;
# ---------- end c_script_3 ----------
c_script_4 = CSharpScript(points=evaluate_curve_2.Point)  # -> selectedPoints; inputs points: tree of Point3d; same code as c_script_3
sort = SortList(Keys=dist)  # -> Keys, ValuesA
sort_2 = SortList(Keys=dist_2)  # -> Keys, ValuesA
line_11 = Line(flatten(line_10))
pt = Point(simplify(branchrearrange))
line_12 = Line(shatter)
item = ListItem(List=sort.Keys, Index=0, Wrap=True)
item_2 = ListItem(List=sort_2.Keys, Index=0, Wrap=True)
smaller = SmallerThan(FirstNumber=item, SecondNumber=0.01)  # -> flatten(SmallerThan), OrEqualTo
smaller_2 = SmallerThan(FirstNumber=item_2, SecondNumber=0.01)  # -> flatten(SmallerThan), OrEqualTo
mesh_2 = Mesh(flatten(singlemesh.meshOut))

# ---- group: Mountain fold lines
crv_3 = Curve(flatten(line_12))

# ---- group: Valley fold lines
crv_4 = Curve(line_11)

# ----
line_13 = Line(StartPoint=c_script_3, EndPoint=c_script_4)
panel_3 = Panel("""1
4""")
panel_4 = Panel("""0
3""")
hingepoints_2 = HingePoints(Mesh=mesh_2)  # -> _1, _2, _3, _4
branchrearrange_4 = CSharpScript(lines=line_13)  # -> A; inputs lines: tree of Line; same code as branchrearrange_2
ln_2 = Line(StartPoint=area.Centroid, EndPoint=c_script_2)
ln_3 = Line(StartPoint=hingepoints_2._1, EndPoint=hingepoints_2._2)  # -> simplify(Line)
pt_2 = Point(flatten(discontinuity.Points))
point_3 = Point(simplifybranches)
point_4 = Point([list_item_9, list_item_10])
medges_2 = MeshEdges(Mesh=mesh_2)  # -> simplify(NakedEdges), simplify(InteriorEdges), simplify(NonManifoldEdges)
demesh_2 = DeconstructMesh(Mesh=mesh_2)  # -> simplify(Vertices), Faces, Colours, Normals
points_2 = PointList(Points=c_script_2, Size=Slider(0.408, range=0..1))
cull_index_2 = CullIndex(List=pt_2, Indices=panel_4, Wrap=True)
eval_4 = EvaluateCurve(Curve=simplify(flatten(ln_3)), Parameter=0.5)  # -> graft(Point), Tangent, Angle
point_5 = Point(flatten([pt_2, point_4]))
show_2 = Show(G=mesh_2)
crv_5 = Curve([branchrearrange_4, branchrearrange_3])
eval_5 = EvaluateCurve(Curve=reparameterize(crv_3), Parameter=0.5)  # -> Point, Tangent, Angle
eval_6 = EvaluateCurve(Curve=reparameterize(crv_4), Parameter=0.5)  # -> Point, Tangent, Angle
point_6 = Point()
plasticanchor_2 = PlasticAnchor(Point=demesh_2.Vertices, Limit=0.01, Strength=0.001)
length_line_2 = LengthLine(Line=[medges_2.NakedEdges, medges_2.InteriorEdges], Strength=1)
eval_7 = EvaluateCurve(Curve=reparameterize(crv_5), Parameter=Slider(1, range=0..1))  # -> Point, Tangent, Angle
pt_3 = Point(eval_7.Point)
item_3 = ListItem(List=pt_3, Index=panel_3, Wrap=True)  # -> simplify(Item)
anchor = Anchor(Point=point_5, Strength=10000)  # -> flatten(A)
dist_3 = Distance(PointA=eval_5.Point, PointB=eval_4.Point)
dist_4 = Distance(PointA=eval_6.Point, PointB=eval_4.Point)
reset = Button()
sort_3 = SortList(Keys=dist_3)  # -> Keys, ValuesA
sort_4 = SortList(Keys=dist_4)  # -> Keys, ValuesA
pt_4 = Point([eval_7.Point, area.Centroid])
number_slider_5 = Slider(180, range=0..1000)
number_slider_6 = Slider(360, range=0..1000)
pt_5 = Point(simplify(branchrearrange))
pt_6 = Point(eval_7.Point)
meshertree_3 = CSharpScript(points=pt_4)  # -> simplify(graft(meshOut)); inputs points: tree of Point3d
# ---------- meshertree_3: C# ----------
    int size = points.BranchCount;

    var mesh = new Mesh[size];

    var organized = new Point3d[size][];

    for( int i = 0; i < size; ++i )
    {

      mesh[i] = new Mesh();
      mesh[i].Vertices.AddVertices(points.Branch(i));

      mesh[i].Faces.AddFace(12, 0, 6);
      mesh[i].Faces.AddFace(12, 6, 1, 7);
      mesh[i].Faces.AddFace(12, 7, 2);
      mesh[i].Faces.AddFace(12, 2, 8);
      mesh[i].Faces.AddFace(12, 8, 3);
      mesh[i].Faces.AddFace(12, 3, 9);
      mesh[i].Faces.AddFace(12, 9, 4, 10);
      mesh[i].Faces.AddFace(12, 10, 5);
      mesh[i].Faces.AddFace(12, 5, 11);
      mesh[i].Faces.AddFace(12, 11, 0);

    }

    meshOut = mesh;
# ---------- end meshertree_3 ----------
item_4 = ListItem(List=sort_3.Keys, Index=0, Wrap=True)
item_5 = ListItem(List=sort_4.Keys, Index=0, Wrap=True)
brep_2 = Brep(rotate.Geometry)
smaller_3 = SmallerThan(FirstNumber=item_4, SecondNumber=0.01)  # -> flatten(SmallerThan), OrEqualTo
smaller_4 = SmallerThan(FirstNumber=item_5, SecondNumber=0.01)  # -> flatten(SmallerThan), OrEqualTo

# ---- group: LadybugFly
toggle = BooleanToggle(True)  # disabled
open_weather_file = Ladybug_OpenEPWWeatherFile(open=toggle)  # -> epwFile; disabled; plug-in component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
ladybug = Ladybug_Ladybug()  # -> Vviiiiiiiiiizzz; disabled; plug-in component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
importepw = Ladybug_ImportEpw(epwFile=open_weather_file)  # -> readMe, latitude, location, dryBulbTemperature, dewPointTemperature, relativeHumidity, windSpeed, windDirection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; disabled; plug-in component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
number_slider_7 = Slider(0.1, range=0..0.1)  # disabled
number_slider_8 = Slider(12, range=0..100)  # disabled
number_slider_9 = Slider(31, range=0..100)  # disabled
number_slider_10 = Slider(12, range=0..100)  # disabled
number_slider_11 = Slider(1, range=0..1)  # disabled
sunpath = Ladybug_SunPath(
    location=importepw.location,
    hour=number_slider_8,
    day=number_slider_9,
    month=number_slider_10,
    timeStep=number_slider_11,
    dailyOrAnnualSunPath=True)  # -> readMe, sunVectors, sunAltitudes, sunAzimuths, port, sunSpheresMesh, sunPathCrvs, compassCrvs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; disabled; plug-in component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
mesh_3 = Mesh()  # disabled
pt_7 = Point()  # disabled
Y = UnitY(Factor=1)  # disabled
c_script_5 = CSharpScript(points=pt_7)  # -> flatten(selectedPoints); inputs points: tree of Point3d; disabled
# ---------- c_script_5: C# ----------
    var pointsOut = new DataTree<Point3d>();

    int branches = points.BranchCount;

    for( int i = 0; i < branches; ++i )
    {

      var path = new GH_Path(i);

      for( int j = 0; j < points.Branch(i).Count; ++j )
      {


        if( i % 2 != 0 && j % 2 != 0 )

          pointsOut.Add(points.Branch(i)[j], path);


      }

    }

    selectedPoints = pointsOut;
# ---------- end c_script_5 ----------
medges_3 = MeshEdges()  # -> NakedEdges, InteriorEdges, NonManifoldEdges; disabled
move = Move(Geometry=c_script_5, Motion=Vector(0, 0, 10))  # -> Geometry, Transform; disabled
move_2 = Move(Geometry=c_script_5, Motion=Y)  # -> Geometry, Transform; disabled
pt_8 = Point(sunpath.sunPositions)  # disabled
number_slider_12 = Slider(0, range=0..1)  # disabled
line_14 = Line(medges_3.InteriorEdges)  # disabled
vec2pt = Vector2Pt(PointA=move_2.Geometry, PointB=c_script_5, Unitize=False)  # -> Vector, Length; disabled
eval_8 = EvaluateCurve(Curve=line_14, Parameter=number_slider_12)  # -> Point, Tangent, Angle; disabled
vdis = VectorDisplay(Anchor=c_script_5, Vector=vec2pt.Vector)  # disabled
meshray = MeshRay(Mesh=mesh_3, Point=c_script_5, Direction=vec2pt.Vector)  # -> Point, Hit; disabled
cp = ClosestPoint(Point=meshray.Point, Cloud=eval_8.Point)  # -> ClosestPoint, CPIndex, Distance; disabled
lng = ListLength(List=cp.ClosestPoint)  # disabled
series = Series(Start=0, Step=1, Count=lng)  # disabled
X = UnitX(Factor=series)  # disabled
move_3 = Move(Geometry=pt_8, Motion=X)  # -> Geometry, Transform; disabled
vec2pt_2 = Vector2Pt(PointA=pt_8, PointB=[cp.ClosestPoint, move.Geometry], Unitize=False)  # -> Vector, Length; disabled
vdis_2 = VectorDisplay(Anchor=pt_8, Vector=vec2pt_2.Vector)  # disabled

# ----
vec = Vector(sunpath.sunVectors)  # disabled
amp = Amplitude(Vector=vec, Amplitude=number_slider_4)  # disabled
vdis_3 = VectorDisplay(Anchor=area.Centroid, Vector=amp)  # disabled
panel_5 = Panel("""1
4""")
panel_6 = Panel("""0
3""")
branchrearrange_5 = CSharpScript(mesh=meshertree_3)  # -> A; inputs mesh: tree of Mesh
# ---------- branchrearrange_5: C# ----------
    var meshOut = new DataTree<Mesh>();

    for( int i = 0; i < mesh.BranchCount; ++i )
      for( int j = 0; j < mesh.Branch(i).Count; ++j )
      {

        meshOut.Add(mesh.Branch(i)[j], new GH_Path(i));

      }

    A = meshOut;
# ---------- end branchrearrange_5 ----------
lng_2 = ListLength(List=flatten)
item_6 = ListItem(List=pt_6, Index=panel_5, Wrap=True)  # -> simplify(Item)
folding_3 = Slider(3.819, range=0..7.4)
folding_4 = Slider(5.04, range=0..10)
pt_9 = Point(flatten(discontinuity.Points))
point_7 = Point([list_item_9, list_item_10])
mesh_4 = Mesh(simplify(branchrearrange_5))
angle = Panel("pi")
angle_2 = Panel("-pi")
multiplication = Multiplication(A=angle_2, B=folding)
num = Number(multiplication)
hinge = Hinge(
    FoldStart=simplify(hingepoints._1),
    FoldEnd=simplify(hingepoints._2),
    Tip1=simplify(hingepoints._3),
    Tip2=simplify(hingepoints._4),
    RestAngle=simplify(num),
    Strength=0.1)  # -> simplify(Hinge)
hinge_2 = Hinge(
    FoldStart=simplify(hingepoints._1),
    FoldEnd=simplify(hingepoints._2),
    Tip1=simplify(hingepoints._3),
    Tip2=simplify(hingepoints._4),
    RestAngle=simplify(num),
    Strength=0.1)  # -> simplify(Hinge)
multiplication_2 = Multiplication(A=angle_2, B=folding_2)
num_2 = Number(multiplication_2)
cull = CullPattern(List=hinge, CullPattern=smaller_2.SmallerThan)
cull_2 = CullPattern(List=hinge_2, CullPattern=smaller.SmallerThan)
hinge_3 = Hinge(
    FoldStart=simplify(hingepoints_2._1),
    FoldEnd=simplify(hingepoints_2._2),
    Tip1=simplify(hingepoints_2._3),
    Tip2=simplify(hingepoints_2._4),
    RestAngle=simplify(num_2),
    Strength=0.1)  # -> simplify(Hinge)
hinge_4 = Hinge(
    FoldStart=simplify(hingepoints_2._1),
    FoldEnd=simplify(hingepoints_2._2),
    Tip1=simplify(hingepoints_2._3),
    Tip2=simplify(hingepoints_2._4),
    RestAngle=simplify(num_2),
    Strength=0.1)  # -> simplify(Hinge)
data = Data(flatten([length_line, show, plasticanchor, cull_2, cull, anchor]))
solver = Solver(GoalObjects=data, Reset=reset, Threshold=1e-15, Tolerance=0.01, On=Toggle(True))  # -> I, V, O
cull_3 = CullPattern(List=hinge_3, CullPattern=smaller_4.SmallerThan)
cull_4 = CullPattern(List=hinge_4, CullPattern=smaller_3.SmallerThan)
onlybreps = CSharpScript(x=solver.O)  # -> out, A; inputs x: tree
# ---------- onlybreps: C# ----------
    var meshOut = new List<object>();

    for( int i = 0; i < x.BranchCount; ++i )
      for( int j = 0; j < x.Branch(i).Count; ++j )
      {
  
        if( x.Branch(i)[j] != null )
          
          if( x.Branch(i)[j].GetType() == typeof( Rhino.Geometry.Mesh ) )
        
            meshOut.Add(x.Branch(i)[j]);
  
      }

    A = meshOut;
# ---------- end onlybreps ----------
crv_6 = Curve(branchrearrange_2)
crv_7 = Curve(crv_5)
cull_index_3 = CullIndex(List=pt_9, Indices=panel_6, Wrap=True)
point_8 = Point(flatten([pt_9, point_7]))
multiplication_3 = Multiplication(A=angle_2, B=folding_3)
dom = ConstructDomain(DomainStart=0, DomainEnd=expr("-x", multiplication_3))
random = Random(Range=dom, Number=lng_2, Seed=Slider(337, range=0..1000))  # -> simplify(graft(Random))
multiplication_4 = Multiplication(A=angle_2, B=folding_4)
anchor_2 = Anchor(Point=pt_9, Strength=10000)  # -> flatten(A)
reset_2 = Button()
number_slider_13 = Slider(180, range=0..1000)
number_slider_14 = Slider(360, range=0..1000)
number_slider_15 = Slider(1, range=0..100)  # disabled
number_slider_16 = Slider(13, range=0..100)  # disabled
number_slider_17 = Slider(0, range=0..100)  # disabled
number_slider_18 = Slider(0, range=0..100)  # disabled
number_slider_19 = Slider(12, range=0..100)  # disabled
number_slider_20 = Slider(0, range=0..100)  # disabled
data_2 = Data(flatten([length_line_2, show_2, plasticanchor_2, cull_4, cull_3, anchor_2]))
solver_2 = Solver(GoalObjects=data_2, Reset=reset_2, Threshold=1e-15, Tolerance=0.01, On=Toggle(False))  # -> I, V, O
brep_3 = Brep(rotate.Geometry)
analysisperiod = Ladybug_AnalysisPeriod(
    fromMonth=number_slider_17,
    fromDay=number_slider_18,
    fromHour=number_slider_19,
    toMonth=number_slider_15,
    toDay=number_slider_20,
    toHour=number_slider_16)  # -> readMe, analysisPeriod; disabled; plug-in component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
onlybreps_2 = CSharpScript(x=solver_2.O)  # -> out, A; inputs x: tree; same code as onlybreps
singlemesh_2 = CSharpScript(points=solver_2.V)  # -> meshOut, A; inputs points: list of Point3d
# ---------- singlemesh_2: C# ----------
    var mesh = new Mesh();

    int size = points.Count;

    mesh.Vertices.AddVertices(points);

    //mesh.Faces.AddFace(6, 7, 2, 1);
    mesh.Faces.AddFace(7, 6, 1, 2);
    mesh.Faces.AddFace(4, 5, 6, 7);
    /*
    mesh.Faces.AddFace(6, 7, 2, 1);
    mesh.Faces.AddFace(6, 1, 8);
    mesh.Faces.AddFace(6, 0, 8);
    mesh.Faces.AddFace(6, 0, 11);
    mesh.Faces.AddFace(6, 11, 5);
    mesh.Faces.AddFace(6, 7, 4, 5);
    mesh.Faces.AddFace(7, 2, 9);
    mesh.Faces.AddFace(7, 3, 9);
    mesh.Faces.AddFace(7, 3, 10);
    mesh.Faces.AddFace(7, 4, 10);
    */

    meshOut = mesh;

    A = points;
# ---------- end singlemesh_2 ----------
area_2 = Area(Geometry=singlemesh_2.meshOut)  # -> Area, Centroid
panel_7 = Panel(area_2.Area)
points_3 = PointList(Points=singlemesh_2.A, Size=Slider(0.1407, range=0..1))
crv_8 = Curve(flatten(crv_6))
mesh_5 = Mesh(flatten(mesh_4))
crv_9 = Curve(flatten(crv_7))
num_3 = Number(multiplication_4)
toggle_2 = BooleanToggle(True)  # disabled
number_slider_21 = Slider(1, range=0..10)  # disabled
Y_2 = UnitY(Factor=number_slider_21)  # -> expr("-x", UnitVector); disabled
mesh_6 = Mesh(singlemesh_2.meshOut)
hingepoints_3 = HingePoints(Mesh=mesh_5)  # -> _1, _2, _3, _4
gencumulativeskymtx = Ladybug_GenCumulativeSkyMtx(epwFile=open_weather_file, skyDensity=0, useOldRes=True, runIt=toggle_2)  # -> readMe, cumulativeSkyMtx; disabled; plug-in component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
medges_4 = MeshEdges(Mesh=mesh_5)  # -> simplify(NakedEdges), simplify(InteriorEdges), simplify(NonManifoldEdges)
demesh_3 = DeconstructMesh(Mesh=mesh_5)  # -> simplify(Vertices), Faces, Colours, Normals
ln_4 = Line(StartPoint=hingepoints_3._1, EndPoint=hingepoints_3._2)  # -> simplify(Line)
move_4 = Move(Geometry=simplifybranches_2, Motion=Y_2)  # -> Geometry, Transform; disabled
hinge_5 = Hinge(
    FoldStart=simplify(hingepoints_3._1),
    FoldEnd=simplify(hingepoints_3._2),
    Tip1=simplify(hingepoints_3._3),
    Tip2=simplify(hingepoints_3._4),
    RestAngle=simplify(num_3),
    Strength=0.1)  # -> simplify(Hinge)
hinge_6 = Hinge(
    FoldStart=simplify(hingepoints_3._1),
    FoldEnd=simplify(hingepoints_3._2),
    Tip1=simplify(hingepoints_3._3),
    Tip2=simplify(hingepoints_3._4),
    RestAngle=simplify(num_3),
    Strength=0.1)  # -> simplify(Hinge)
show_3 = Show(G=mesh_5)
eval_9 = EvaluateCurve(Curve=ln_4, Parameter=0.5)  # -> graft(Point), Tangent, Angle
eval_10 = EvaluateCurve(Curve=reparameterize(crv_9), Parameter=0.5)  # -> Point, Tangent, Angle
eval_11 = EvaluateCurve(Curve=reparameterize(crv_8), Parameter=0.5)  # -> Point, Tangent, Angle
plasticanchor_3 = PlasticAnchor(Point=demesh_3.Vertices, Limit=0.01, Strength=0.001)
length_line_3 = LengthLine(Line=[medges_4.NakedEdges, medges_4.InteriorEdges], Strength=1)
selectskymtx = Ladybug_selectSkyMtx(
    cumulativeSkyMtx=gencumulativeskymtx.cumulativeSkyMtx,
    analysisPeriod=analysisperiod.analysisPeriod,
    removeDiffuse=False,
    removeDirect=False)  # -> readMe, selectedSkyMtx; disabled; plug-in component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
dist_5 = Distance(PointA=eval_10.Point, PointB=eval_9.Point)
dist_6 = Distance(PointA=eval_11.Point, PointB=eval_9.Point)
sort_5 = SortList(Keys=dist_5)  # -> Keys, ValuesA
sort_6 = SortList(Keys=dist_6)  # -> Keys, ValuesA
move_5 = Move(Geometry=simplifybranches_2, Motion=expr("-x*2", sunpath.sunVectors))  # -> Geometry, Transform; disabled
pt_10 = Point(simplify(branchrearrange))
pt_11 = Point(eval_7.Point)
item_7 = ListItem(List=sort_5.Keys, Index=0, Wrap=True)
item_8 = ListItem(List=sort_6.Keys, Index=0, Wrap=True)
smaller_5 = SmallerThan(FirstNumber=item_7, SecondNumber=0.01)  # -> flatten(SmallerThan), OrEqualTo
smaller_6 = SmallerThan(FirstNumber=item_8, SecondNumber=0.01)  # -> flatten(SmallerThan), OrEqualTo
cull_5 = CullPattern(List=hinge_5, CullPattern=smaller_6.SmallerThan)
panel_8 = Panel("""1
4""")
cull_6 = CullPattern(List=hinge_6, CullPattern=smaller_5.SmallerThan)
item_9 = ListItem(List=pt_11, Index=panel_8, Wrap=True)  # -> simplify(Item)
pt_12 = Point(flatten([item_9, pt_10]))
anchor_3 = Anchor(Point=pt_12, Strength=10000)
reset_3 = Button()
number_slider_22 = Slider(180, range=0..1000)
number_slider_23 = Slider(360, range=0..1000)
data_3 = Data([length_line_3, show_3, plasticanchor_3, anchor_3, cull_6, cull_5])
solver_3 = Solver(GoalObjects=data_3, Reset=reset_3, Threshold=1e-15, Tolerance=0.01, On=Toggle(True))  # -> I, V, O
brep_4 = Brep(rotate.Geometry)
onlybreps_3 = CSharpScript(x=solver_3.O)  # -> out, A; inputs x: tree; same code as onlybreps
forwardraytracing = Ladybug_ForwardRaytracing(
    startPts=move_4.Geometry,
    startVectors=graft(sunpath.sunVectors),
    context=flatten(onlybreps_3.A),
    numOfBounce=2,
    lastBounceLen=10)  # -> rays; disabled; plug-in component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
hull = ConvexHull(Points=flatten(pt_12), Plane=xz)  # -> Hull, HullZ, Indices; disabled
number_slider_24 = Slider(0.1, range=0..1)  # disabled
number_slider_25 = Slider(0.5, range=0..1)  # disabled
toggle_3 = BooleanToggle(False)  # disabled
toggle_4 = BooleanToggle(True)  # disabled
brep_5 = Brep(hull.Hull)  # disabled
radiationanalysis = Ladybug_RadiationAnalysis(
    geometry=flatten(brep_5),
    context=flatten(onlybreps_3.A),
    gridSize=number_slider_24,
    disFromBase=number_slider_24,
    selectedSkyMtx=flatten(selectskymtx.selectedSkyMtx),
    parallel=toggle_4,
    runIt=toggle_4)  # -> readMe, contextMesh, analysisMesh, testPts, testVec, port, radiationResult, radiationMesh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; disabled; plug-in component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
sunlighthoursanalysis = Ladybug_SunlightHoursAnalysis(
    geometry=flatten(brep_4),
    context=flatten(brep_4),
    gridSize=number_slider_25,
    disFromBase=number_slider_25,
    sunVectors=flatten(sunpath.sunVectors),
    timeStep=1,
    parallel=toggle_3,
    runIt=toggle_3)  # -> readMe, contextMesh, analysisMesh, testPts, testVec, port, sunlightHoursResult, sunlightHoursMesh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; disabled; plug-in component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

# ---- group: GottaLearnHowToCrawlBeforeYouCanRun...
# You can replace the mesh with a different
# pattern, and choose edges from it to assign
# to mountain or valley folds.
# To start, Press the 'Reset' button below  then slowly change the 'Folding' slider.
number_slider_26 = Slider(2, range=0..50)  # disabled
number_slider_27 = Slider(2, range=0..10)  # disabled
xz_2 = XZPlane(Origin=Point(0, 0, 0))  # disabled
xz_3 = XZPlane(Origin=Point(0, 0, 0))  # disabled
square = Square(Plane=xz_2, Size=1, ExtentX=number_slider_26, ExtentY=number_slider_26)  # -> Cells, Points; disabled
addition = Addition(A=number_slider_27, B=number_slider_26)  # disabled
subtraction = Subtraction(A=addition, B=number_slider_27)  # disabled
points_4 = PointList(Points=square.Points)  # disabled
panel_9 = Panel(square.Points)  # disabled
number_slider_28 = Slider(0.08106, range=0..1)  # disabled
addition_2 = Addition(A=subtraction, B=number_slider_28)  # disabled
X_2 = UnitX(Factor=addition_2)  # disabled
folding_5 = Slider(0.99, range=0..0.99)  # disabled
folding_6 = Slider(0.99, range=0..0.99)  # disabled
angle_3 = Panel("pi")  # disabled
angle_4 = Panel("-pi")  # disabled
multiplication_5 = Multiplication(A=angle_3, B=folding_5)  # disabled
multiplication_6 = Multiplication(A=angle_4, B=folding_5)  # disabled
toggle_5 = BooleanToggle(True)  # disabled
reset_4 = Button()  # disabled

# ---- group: SomeComponentsWeMightOrMightNotNeed
point_9 = Point(square.Points)  # disabled
branchrearrange_6 = CSharpScript()  # -> A; inputs number: tree of Double; disabled
# ---------- branchrearrange_6: C# ----------
    var doubleOut = new DataTree<double>();

    for( int i = 0; i < number.BranchCount; ++i )
      for( int j = 0; j < number.Branch(i).Count; ++j )
      {

        doubleOut.Add(number.Branch(i)[j], new GH_Path(j));

      }

    A = doubleOut;
# ---------- end branchrearrange_6 ----------
meshing = CSharpScript()  # -> Mesh; inputs points: list of Point3d; disabled
# ---------- meshing: C# ----------
    var mesh = new Mesh();

    mesh.Vertices.AddVertices(points);

    //for( int i = 0; i < 2; ++i )
    //{

      mesh.Faces.AddFace( 4, 1, 0 );

      mesh.Faces.AddFace( 4, 2, 1 );

      mesh.Faces.AddFace( 4, 2, 5 );
      
      mesh.Faces.AddFace( 4, 5, 8 );
    
      mesh.Faces.AddFace( 4, 8, 7 );
    
      mesh.Faces.AddFace( 4, 7, 6 );

      mesh.Faces.AddFace( 4, 6, 3 );
    
      mesh.Faces.AddFace( 4, 0, 3 );
    
    //}

    Mesh = mesh;
# ---------- end meshing ----------
mesher = CSharpScript()  # -> meshOut, A; inputs points: list of Point3d, dis: Double; disabled
# ---------- mesher: C# ----------
    var mesh = new Mesh();

    int size = points.Count;

    var organized = Point3d.SortAndCullPointList(points, 0.001);

    mesh.Vertices.AddVertices(organized);

    double distance = organized[0].DistanceTo(organized[1]);

    if( AlmostEqualTo( distance, dis ) == false )
    {

      mesh.Faces.AddFace(0, 1, 12);
      mesh.Faces.AddFace(0, 1, 2);
      mesh.Faces.AddFace(0, 2, 3, 4);
      mesh.Faces.AddFace(0, 4, 5);
      mesh.Faces.AddFace(0, 5, 6);
      mesh.Faces.AddFace(0, 6, 7);
      mesh.Faces.AddFace(0, 7, 8);
      mesh.Faces.AddFace(0, 8, 9, 10);
      mesh.Faces.AddFace(0, 10, 11);
      mesh.Faces.AddFace(0, 11, 12);

    }

    else
    {

      mesh.Faces.AddFace(12, 0, 1);
      mesh.Faces.AddFace(12, 1, 2);
      mesh.Faces.AddFace(12, 2, 3, 4);
      mesh.Faces.AddFace(12, 4, 5);
      mesh.Faces.AddFace(12, 5, 6);
      mesh.Faces.AddFace(12, 6, 7);
      mesh.Faces.AddFace(12, 7, 8);
      mesh.Faces.AddFace(12, 8, 9, 10);
      mesh.Faces.AddFace(12, 10, 11);
      mesh.Faces.AddFace(12, 11, 0);

    }

    meshOut = mesh;

    A = organized;
# ---------- mesher: C# additional code ----------
  public static bool AlmostEqualTo(double value1, double value2)
  {
    return Math.Abs(value1 - value2) < 0.0000001; 
  }
# ---------- end mesher ----------
number_slider_29 = Slider(0, range=0..100)  # disabled
c_script_6 = CSharpScript()  # -> A; inputs points: list of Point3d; disabled
# ---------- c_script_6: C# ----------
    var pointsOut = new List<Point3d>();
    
    var size = points.Count;
    
    for( int i = 0; i < size; ++i )
    {
      
      if( i % 3 != 1 )
      {
        
        pointsOut.Add( points[i] );
      
      }
      
    }
    
    A = pointsOut;
# ---------- end c_script_6 ----------
boolean_toggle = BooleanToggle(True)  # disabled
c_script_7 = CSharpScript(points=point_9)  # -> selectedPoints; inputs points: tree of Point3d; disabled; same code as c_script_5
c_script_8 = CSharpScript(Reference="C:\USERS\PAULA\DOWNLOADS\kangaroo2\KangarooSolver.dll")  # -> out, A, B; inputs x: list; disabled
# ---------- c_script_8: C# ----------
    
    var PS = new KangarooSolver.PhysicalSystem();
    double tol = 0.0001; // points closer than this will get combined into a single particle
    var GoalList = new List<IGoal>();

    //Assign indexes to the particles in each Goal:
    foreach(IGoal G in x)
    {
      PS.AssignPIndex(G, tol);
      GoalList.Add(G);
    }

    int counter = 0;
    double threshold = 1e-10;
    do
    {
      PS.Step(GoalList, false, threshold); // The step will iterate until either reaching 15ms or the energy threshold
      counter++;
    }while(PS.GetvSum() > threshold && counter < 100); //GetvSum returns the current kinetic energy
    // always include a counter to prevent it getting stuck forever in case it cannot reach the given threshold

    A = PS.GetOutput(GoalList);
    B = counter;
# ---------- end c_script_8 ----------
path = ConstructPath(Indices=number_slider_29)  # disabled
branch = TreeBranch(Path=path, MaintainPaths=True)  # disabled
getmebranches = CSharpScript(tree=square.Points, clockWise=boolean_toggle)  # -> A; inputs tree: tree of Point3d, clockWise: Boolean; disabled
# ---------- getmebranches: C# ----------
    var linesOut = new DataTree<Point3d>();

    var branches = tree.BranchCount;

    int x = 0, y = 0;

    bool flag = clockWise;

    if( flag == true )
    {

      x = 0; y = 1;

    }

    if( flag == false )
    {

      x = 1; y = 0;

    }

    for( int i = 0; i < branches; ++i )
      for( int j = 0; j < tree.Branch(i).Count; ++j )
      {

        var path = new GH_Path(i);

        if( i % 2 != 0 && j % 2 != x )
          if( flag == true )

            linesOut.Add(tree.Branch(i)[j], path);

          else
          {

            linesOut.Add(tree.Branch(i)[j], path);

          }

        if( i % 2 != 1 && j % 2 != y )
          if( flag == true )

            linesOut.Add(tree.Branch(i)[j], path);

          else
          {

            linesOut.Add(tree.Branch(i)[j], path);

          }

      }

    A = linesOut;
# ---------- end getmebranches ----------
unit_z = UnitZ(Factor=1)  # disabled
goalsbrancher = CSharpScript(Reference="C:\USERS\PAULA\DOWNLOADS\KANGAROO2\KangarooSolver.dll")  # -> A; inputs goals: tree; disabled
# ---------- goalsbrancher: C# ----------
    PS = new KangarooSolver.PhysicalSystem();
    
    for( int i = 0; i < goals.BranchCount; ++i )
      for( int j = 0; j < goals.Branch(i).Count; ++j )
      {

        goalsOut.Add(goals.Branch(i)[j], new GH_Path(i));

      }

    /*
    for( int i = 0; i < goals.Count; ++i )
    {

      goalsOut.Add(goals[i], new GH_Path(i));

    }
    */

    A = goalsOut;
# ---------- goalsbrancher: C# additional code ----------
  KangarooSolver.PhysicalSystem PS = new KangarooSolver.PhysicalSystem();
  DataTree<object> goalsOut = new DataTree<object>();
# ---------- end goalsbrancher ----------
c_script_9 = CSharpScript(points=branch)  # -> meshOut, A; inputs points: list of Point3d; disabled
# ---------- c_script_9: C# ----------
    var mesh = new Mesh();

    int size = points.Count;

    var organized = Point3d.SortAndCullPointList(points, 0.001);

    mesh.Vertices.AddVertices(organized);

    mesh.Faces.AddFace(0, 1, 12);
    mesh.Faces.AddFace(0, 1, 2);
    mesh.Faces.AddFace(0, 2, 3, 4);
    mesh.Faces.AddFace(0, 4, 5);
    mesh.Faces.AddFace(0, 5, 6);
    mesh.Faces.AddFace(0, 6, 7);
    mesh.Faces.AddFace(0, 7, 8);
    mesh.Faces.AddFace(0, 8, 9, 10);
    mesh.Faces.AddFace(0, 10, 11);
    mesh.Faces.AddFace(0, 11, 12);
    
    /*
    for( int i = 0; i < size; ++i )
    {

      mesh.Faces.AddFace(0, i + 1, i + 2, i + 3);

      //if( i == size - 1 )

        //mesh.Faces.AddFace(0, 1, size - 1);

    }
    */

    meshOut = mesh;

    A = organized;
# ---------- end c_script_9 ----------
number_slider_30 = Slider(0.1407, range=0..1)  # disabled
number_slider_31 = Slider(1, range=0..1)  # disabled
move_6 = Move(Geometry=c_script_7, Motion=unit_z)  # -> Geometry, Transform; disabled
goalsbrancher_2 = CSharpScript(Reference="C:\USERS\PAULA\DOWNLOADS\KANGAROO2\KangarooSolver.dll")  # -> A; inputs goals: tree; disabled; same code as goalsbrancher
points_5 = PointList(Points=c_script_9.A, Size=number_slider_30)  # disabled
customiteration = CSharpScript(Reference="C:\USERS\PAULA\DOWNLOADS\KANGAROO2\KangarooSolver.dll")  # -> out, A, B; inputs x: list; disabled
# ---------- customiteration: C# ----------
    var PS = new KangarooSolver.PhysicalSystem();
    double tol = 0.0001; // points closer than this will get combined into a single particle
    var GoalList = new List<IGoal>();

    //Assign indexes to the particles in each Goal:
    foreach(IGoal G in x)
    {
      PS.AssignPIndex(G, tol);
      GoalList.Add(G);
    }

    int counter = 0;
    double threshold = 1e-10;
    do
    {
      PS.Step(GoalList, false, threshold); // The step will iterate until either reaching 15ms or the energy threshold
      counter++;
    }while(PS.GetvSum() > threshold && counter < 100); //GetvSum returns the current kinetic energy
    // always include a counter to prevent it getting stuck forever in case it cannot reach the given threshold

    A = PS.GetOutput(GoalList);
    B = counter;
# ---------- end customiteration ----------
point_list_3 = PointList(Points=getmebranches, Size=number_slider_31)  # disabled
point_list_4 = PointList(Points=c_script_7, Size=number_slider_31)  # disabled

# ---- group: GottaLearnHowToCrawlBeforeYouCanRun... / ThisAintThePrettiestButItGetsThingsDone
boolean_toggle_2 = BooleanToggle(False)  # disabled
panel_10 = Panel("{0;0;1}")  # disabled
panel_11 = Panel("{0;0;1}(-1)")  # disabled
panel_12 = Panel("{0;0;0}[+1]")  # disabled
panel_13 = Panel("{0;0;+1}[+1]")  # disabled
relative_item = RelativeItem(Tree=square.Points, Offset=panel_10, WrapPaths=boolean_toggle_2, WrapItems=boolean_toggle_2)  # -> ItemA, ItemB; disabled
relative_item_2 = RelativeItem(Tree=square.Points, Offset=panel_12, WrapPaths=boolean_toggle_2, WrapItems=boolean_toggle_2)  # -> ItemA, ItemB; disabled
relative_item_3 = RelativeItem(Tree=square.Points, Offset=panel_13, WrapPaths=boolean_toggle_2, WrapItems=boolean_toggle_2)  # -> ItemA, ItemB; disabled
relative_item_4 = RelativeItem(Tree=square.Points, Offset=panel_11, WrapPaths=boolean_toggle_2, WrapItems=boolean_toggle_2)  # -> ItemA, ItemB; disabled

# ---- group: GottaLearnHowToCrawlBeforeYouCanRun... / GiveMeThemLines
line_15 = Line(StartPoint=relative_item_3.ItemA, EndPoint=relative_item_3.ItemB)  # -> simplify(Line); disabled
line_16 = Line(StartPoint=relative_item_4.ItemA, EndPoint=relative_item_4.ItemB)  # -> simplify(Line); disabled
line_17 = Line(StartPoint=relative_item_2.ItemA, EndPoint=relative_item_2.ItemB)  # -> simplify(Line); disabled
boolean_toggle_3 = BooleanToggle(True)  # disabled
boolean_toggle_4 = BooleanToggle(False)  # disabled
line_18 = Line(StartPoint=relative_item.ItemA, EndPoint=relative_item.ItemB)  # -> simplify(Line); disabled
c_script_10 = CSharpScript(lines=line_17)  # -> linesOut; inputs lines: tree of Line; disabled
# ---------- c_script_10: C# ----------
    int branches = lines.BranchCount;

    var newLines = new DataTree<Line>();
    
    var p = new int[branches];
    
    for( int i = 0; i < branches; ++i )
    {

      for( int j = 0; j < lines.Branch(i).Count; ++j )
      {

        if( i % 2 != 1 )
        {

          newLines.Add(lines.Branch(i)[j], new GH_Path(i/2));

        }
        
      }

    }

    linesOut = newLines;
# ---------- end c_script_10 ----------
getmebranches_2 = CSharpScript(tree=line_15, clockWise=boolean_toggle_3)  # -> A; inputs tree: tree of Line, clockWise: Boolean; disabled
# ---------- getmebranches_2: C# ----------
    var linesOut = new DataTree<Line>();

    var branches = tree.BranchCount;

    int x = 0, y = 0;

    bool flag = clockWise;

    if( flag == true )
    {

      x = 0; y = 1;

    }

    if( flag == false )
    {

      x = 1; y = 0;

    }

    for( int i = 0; i < branches; ++i )
      for( int j = 0; j < tree.Branch(i).Count; ++j )
      {

        var path = new GH_Path(i);

        if( i % 2 != 0 && j % 2 != x )
          if( flag == true )

            linesOut.Add(tree.Branch(i)[j], path);

          else
          {

            linesOut.Add(tree.Branch(i)[j], path);

          }

        if( i % 2 != 1 && j % 2 != y )
          if( flag == true )

            linesOut.Add(tree.Branch(i)[j], path);

          else
          {

            linesOut.Add(tree.Branch(i)[j], path);

          }

      }

    A = linesOut;
# ---------- end getmebranches_2 ----------
getmebranches_3 = CSharpScript(tree=line_16, clockWise=boolean_toggle_4)  # -> A; inputs tree: tree of Line, clockWise: Boolean; disabled; same code as getmebranches_2

# ---- group: GottaLearnHowToCrawlBeforeYouCanRun... / GiveMeAMesh
number_slider_32 = Slider(4, range=0..5)  # disabled
line_19 = Line([line_18, getmebranches_2, getmebranches_3, c_script_10])  # disabled
weaverbird_s_mesh_from_lines_weave_back = WeaverbirdsMeshFromLinesWeaveBack(Lines=flatten(line_19), MaximumValence=number_slider_32)  # disabled

# ---- group: GottaLearnHowToCrawlBeforeYouCanRun... / AnchorPointsWeWantThemFixed
c_script_11 = CSharpScript(lines=line_17)  # -> linesOut; inputs lines: tree of Line; disabled
# ---------- c_script_11: C# ----------
    int branches = lines.BranchCount;

    var newLines = new DataTree<Line>();

    for( int i = 0; i < branches; ++i )
      for( int j = 0; j < lines.Branch(i).Count; ++j )
      {

        var path = new GH_Path(i);

        if( i % 2 != 0 )

          newLines.Add(lines.Branch(i)[j], path);

      }

    linesOut = newLines;
# ---------- end c_script_11 ----------
c_script_12 = CSharpScript(lines=line_18)  # -> linesOut; inputs lines: tree of Line; disabled
# ---------- c_script_12: C# ----------
    int branches = lines.BranchCount;

    var newLines = new DataTree<Line>();

    var p = new int[branches];

    for( int i = 0; i < branches; ++i )
    {

      for( int j = 0; j < lines.Branch(i).Count; ++j )
      {

        if( j % 2 != 1 )
        {

          newLines.Add(lines.Branch(i)[j], new GH_Path(j/2));

        }

      }

    }

    linesOut = newLines;
# ---------- end c_script_12 ----------
join_2 = JoinCurves(Curves=c_script_11, Preserve=False)  # disabled
join_3 = JoinCurves(Curves=c_script_12, Preserve=False)  # disabled
join_4 = JoinCurves(Curves=c_script_10, Preserve=False)  # disabled
end = EndPoints(Curve=join_2)  # -> Start, End; disabled
ccx = CurveCurve(CurveA=flatten(join_3), CurveB=join_4)  # -> flatten(Points), ParamsA, ParamsB; disabled
pt_13 = Point(flatten([end.Start, end.End, ccx.Points]))  # disabled

# ---- group: GottaLearnHowToCrawlBeforeYouCanRun... (continued)
crv_10 = Curve([getmebranches_2, getmebranches_3])  # disabled
move_7 = Move(Geometry=crv_10, Motion=X_2)  # -> Geometry, Transform; disabled
crv_11 = Curve([line_18, c_script_10])  # disabled
move_8 = Move(Geometry=crv_11, Motion=X_2)  # -> Geometry, Transform; disabled
move_9 = Move(Geometry=weaverbird_s_mesh_from_lines_weave_back, Motion=X_2)  # -> Geometry, Transform; disabled
move_10 = Move(Geometry=pt_13, Motion=X_2)  # -> Geometry, Transform; disabled
anchor_4 = Anchor(Point=[pt_13, move_10.Geometry], Strength=10000)  # disabled

# ---- group: GottaLearnHowToCrawlBeforeYouCanRun... / mesh of flat folding pattern
mesh_7 = Mesh(simplify(graft([weaverbird_s_mesh_from_lines_weave_back, move_9.Geometry])))  # disabled

# ---- group: GottaLearnHowToCrawlBeforeYouCanRun... / Mountain fold lines
crv_12 = Curve([crv_10, move_7.Geometry])  # disabled

# ---- group: GottaLearnHowToCrawlBeforeYouCanRun... / Valley fold lines
crv_13 = Curve([crv_11, move_8.Geometry])  # disabled

# ---- group: GottaLearnHowToCrawlBeforeYouCanRun...
multiplication_7 = Multiplication(A=angle_3, B=folding_6)  # disabled
hingepoints_4 = HingePoints(Mesh=mesh_7)  # -> _1, _2, _3, _4; disabled
multiplication_8 = Multiplication(A=angle_4, B=folding_6)  # disabled
ln_5 = Line(StartPoint=hingepoints_4._1, EndPoint=hingepoints_4._2)  # disabled
hinge_7 = Hinge(
    FoldStart=hingepoints_4._1,
    FoldEnd=hingepoints_4._2,
    Tip1=hingepoints_4._3,
    Tip2=hingepoints_4._4,
    RestAngle=simplify(graft([multiplication_7, multiplication_5])),
    Strength=0.1)  # disabled
hinge_8 = Hinge(
    FoldStart=hingepoints_4._1,
    FoldEnd=hingepoints_4._2,
    Tip1=hingepoints_4._3,
    Tip2=hingepoints_4._4,
    RestAngle=simplify(graft([multiplication_8, multiplication_6])),
    Strength=0.1)  # disabled
show_4 = Show(G=mesh_7)  # disabled
eval_12 = EvaluateCurve(Curve=reparameterize(crv_13), Parameter=0.5)  # -> Point, Tangent, Angle; disabled
eval_13 = EvaluateCurve(Curve=reparameterize(crv_12), Parameter=0.5)  # -> Point, Tangent, Angle; disabled
eval_14 = EvaluateCurve(Curve=ln_5, Parameter=0.5)  # -> graft(Point), Tangent, Angle; disabled
dist_7 = Distance(PointA=eval_12.Point, PointB=eval_14.Point)  # disabled
dist_8 = Distance(PointA=eval_13.Point, PointB=eval_14.Point)  # disabled
sort_7 = SortList(Keys=dist_7)  # -> Keys, ValuesA; disabled
sort_8 = SortList(Keys=dist_8)  # -> Keys, ValuesA; disabled
item_10 = ListItem(List=sort_7.Keys, Index=0, Wrap=True)  # disabled
item_11 = ListItem(List=sort_8.Keys, Index=0, Wrap=True)  # disabled
smaller_7 = SmallerThan(FirstNumber=item_10, SecondNumber=0.01)  # -> flatten(SmallerThan), OrEqualTo; disabled
smaller_8 = SmallerThan(FirstNumber=item_11, SecondNumber=0.01)  # -> flatten(SmallerThan), OrEqualTo; disabled
cull_7 = CullPattern(List=hinge_7, CullPattern=smaller_8.SmallerThan)  # disabled
cull_8 = CullPattern(List=hinge_8, CullPattern=smaller_7.SmallerThan)  # disabled

# ---- group: GottaLearnHowToCrawlBeforeYouCanRun... / maintain edge lengths
medges_5 = MeshEdges(Mesh=mesh_7)  # -> NakedEdges, InteriorEdges, NonManifoldEdges; disabled
length_line_4 = LengthLine(Line=[medges_5.NakedEdges, medges_5.InteriorEdges], Strength=1)  # disabled

# ---- group: GottaLearnHowToCrawlBeforeYouCanRun... / a weak plastic anchor on all points prevents drift
demesh_4 = DeconstructMesh(Mesh=mesh_7)  # -> Vertices, Faces, Colours, Normals; disabled
plasticanchor_4 = PlasticAnchor(Point=demesh_4.Vertices, Limit=0.01, Strength=0.001)  # disabled

# ---- group: GottaLearnHowToCrawlBeforeYouCanRun... (continued)
data_4 = Data([length_line_4, cull_8, cull_7, show_4, plasticanchor_4, anchor_4])  # disabled
solver_4 = Solver(GoalObjects=data_4, Reset=reset_4, Threshold=1e-15, Tolerance=0.01, On=toggle_5)  # -> I, V, O; disabled
