# Grasshopper definition FacadeMechanism.gh (Grasshopper 0.9.76)
# plug-ins: TT Toolbox

number_slider = Slider(5.576, range=0..10)
multiplication = Multiplication(A=number_slider, B=2.135)
pt = ConstructPoint(XCoordinate=Slider(0, range=0..10), YCoordinate=Slider(0, range=0..10), ZCoordinate=Slider(0, range=0..10))
pt_2 = ConstructPoint(XCoordinate=Slider(0, range=0..10), YCoordinate=Slider(0, range=0..10), ZCoordinate=Slider(0, range=0..10))
pt_3 = ConstructPoint(XCoordinate=Slider(0, range=0..10), YCoordinate=Slider(0, range=0..10), ZCoordinate=Slider(0, range=0..10))
pt_4 = ConstructPoint(XCoordinate=Slider(0, range=0..10), YCoordinate=Slider(0, range=0..10), ZCoordinate=Slider(0, range=0..10))
number_slider_2 = Slider(10, range=0..10)
number_slider_3 = Slider(4.337, range=0..10)
number_slider_4 = Slider(4.416, range=0..10)
number_slider_5 = Slider(4.368, range=0..10)
Z = UnitZ(Factor=number_slider_3)  # -> expr("x*0.2", UnitVector)
ellipse = Ellipse(Plane=pt_4, Radius1=number_slider, Radius2=multiplication)  # -> Ellipse, Focus1, Focus2
cir = Circle(Plane=pt_3, Radius=1)
ellipse_2 = Ellipse(Plane=pt_2, Radius1=number_slider, Radius2=multiplication)  # -> Ellipse, Focus1, Focus2
ellipse_3 = Ellipse(Plane=pt_3, Radius1=number_slider, Radius2=multiplication)  # -> Ellipse, Focus1, Focus2
ellipse_4 = Ellipse(Plane=pt_4, Radius1=number_slider, Radius2=multiplication)  # -> Ellipse, Focus1, Focus2
cir_2 = Circle(Plane=pt_4, Radius=1)
Z_2 = UnitZ(Factor=number_slider_3)  # -> expr("x*0.2", UnitVector)
Z_3 = UnitZ(Factor=number_slider_3)  # -> expr("x*0.2", UnitVector)
Z_4 = UnitZ(Factor=number_slider_3)  # -> expr("x*0.2", UnitVector)
logarithm = Logarithm(Value=number_slider_3)
move = Move(Geometry=pt, Motion=expr("-x", Z))  # -> Geometry, Transform
move_2 = Move(Geometry=pt_2, Motion=expr("-x", Z_2))  # -> Geometry, Transform
move_3 = Move(Geometry=pt_3, Motion=expr("-x", Z_3))  # -> Geometry, Transform
panel = Panel(logarithm)
move_4 = Move(Geometry=pt_4, Motion=expr("-x", Z_4))  # -> Geometry, Transform
move_5 = Move(Geometry=move.Geometry, Motion=expr("-x", Z))  # -> Geometry, Transform
divide = DivideCurve(Curve=ellipse.Ellipse, Count=Slider(3, range=0..10), Kinks=False)  # -> Points, Tangents, Parameters
move_6 = Move(Geometry=move_2.Geometry, Motion=expr("-x", Z_2))  # -> Geometry, Transform
move_7 = Move(Geometry=move_3.Geometry, Motion=expr("-x", Z_3))  # -> Geometry, Transform
divide_2 = DivideCurve(Curve=ellipse_2.Ellipse, Count=Slider(3, range=0..10), Kinks=False)  # -> Points, Tangents, Parameters
divide_3 = DivideCurve(Curve=ellipse_3.Ellipse, Count=Slider(3, range=0..10), Kinks=False)  # -> Points, Tangents, Parameters
move_8 = Move(Geometry=move_4.Geometry, Motion=expr("-x", Z_4))  # -> Geometry, Transform
divide_4 = DivideCurve(Curve=ellipse_4.Ellipse, Count=Slider(3, range=0..10), Kinks=False)  # -> Points, Tangents, Parameters
shift = ShiftList(List=divide.Points, Shift=1, Wrap=True)
ln = Line(StartPoint=divide.Points, EndPoint=shift)
shift_2 = ShiftList(List=divide_2.Points, Shift=1, Wrap=True)
ln_2 = Line(StartPoint=divide_2.Points, EndPoint=shift_2)
mirror = Mirror(Geometry=divide_3.Points, Plane=PlaneYZ(0, 0, 0))  # -> Geometry, Transform
shift_3 = ShiftList(List=mirror.Geometry, Shift=1, Wrap=True)
ln_3 = Line(StartPoint=mirror.Geometry, EndPoint=shift_3)
list_item = ListItem(List=mirror.Geometry, Index=Slider(0, range=0..2), Wrap=True)
move_9 = Move(Geometry=ln, Motion=expr("-x", Z))  # -> Geometry, Transform
join_curves = JoinCurves(Curves=move_9.Geometry, Preserve=False)
area = Area(Geometry=join_curves)  # -> Area, Centroid
mirror_2 = Mirror(Geometry=divide_4.Points, Plane=PlaneYZ(0, 0, 0))  # -> Geometry, Transform
shift_4 = ShiftList(List=mirror_2.Geometry, Shift=1, Wrap=True)
ln_4 = Line(StartPoint=mirror_2.Geometry, EndPoint=shift_4)
list_item_2 = ListItem(List=mirror_2.Geometry, Index=Slider(0, range=0..2), Wrap=True)
move_10 = Move(Geometry=ln_2, Motion=expr("-x", Z_2))  # -> Geometry, Transform
join_curves_2 = JoinCurves(Curves=move_10.Geometry, Preserve=False)
move_11 = Move(Geometry=ln_3, Motion=expr("-x", Z_3))  # -> Geometry, Transform
join_curves_3 = JoinCurves(Curves=move_11.Geometry, Preserve=False)
area_2 = Area(Geometry=join_curves_3)  # -> Area, Centroid
move_12 = Move(Geometry=ln_4, Motion=expr("-x", Z_4))  # -> Geometry, Transform
join_curves_4 = JoinCurves(Curves=move_12.Geometry, Preserve=False)
area_3 = Area(Geometry=join_curves_4)  # -> Area, Centroid
area_4 = Area(Geometry=join_curves_2)  # -> Area, Centroid
scale = Scale(Geometry=move_9.Geometry, Center=area.Centroid, Factor=logarithm)  # -> Geometry, Transform
divide_5 = DivideCurve(Curve=scale.Geometry, Count=Slider(2, range=0..3), Kinks=False)  # -> Points, Tangents, Parameters
scale_2 = Scale(Geometry=move_11.Geometry, Center=area_2.Centroid, Factor=logarithm)  # -> Geometry, Transform
divide_6 = DivideCurve(Curve=scale_2.Geometry, Count=Slider(2, range=0..3), Kinks=False)  # -> Points, Tangents, Parameters
scale_3 = Scale(Geometry=move_12.Geometry, Center=area_3.Centroid, Factor=logarithm)  # -> Geometry, Transform
divide_7 = DivideCurve(Curve=scale_3.Geometry, Count=Slider(2, range=0..3), Kinks=False)  # -> Points, Tangents, Parameters
scale_4 = Scale(Geometry=move_10.Geometry, Center=area_4.Centroid, Factor=logarithm)  # -> Geometry, Transform
divide_8 = DivideCurve(Curve=scale_4.Geometry, Count=Slider(2, range=0..3), Kinks=False)  # -> Points, Tangents, Parameters
item = ListItem(List=divide_5.Points, Index=Slider(1, range=0..1), Wrap=True)  # -> flatten(Item)
item_2 = ListItem(List=divide_8.Points, Index=Slider(1, range=0..1), Wrap=True)  # -> flatten(Item)
item_3 = ListItem(List=divide_6.Points, Index=Slider(1, range=0..1), Wrap=True)  # -> flatten(Item)
item_4 = ListItem(List=divide_7.Points, Index=Slider(1, range=0..1), Wrap=True)  # -> flatten(Item)
list_item_3 = ListItem(List=divide_2.Points, Index=Slider(0, range=0..2), Wrap=True)
list_item_4 = ListItem(List=mirror_2.Geometry, Index=Slider(0, range=0..2), Wrap=True)
pt_5 = Point(flatten([item, divide.Points]))
pt_6 = Point(flatten([item_2, divide_2.Points]))
pt_7 = Point(flatten([item_3, mirror.Geometry]))
pt_8 = Point(flatten([item_4, mirror_2.Geometry]))
vector_2pt = Vector2Pt(PointA=list_item_4, PointB=list_item_3, Unitize=False)  # -> Vector, Length
ln_5 = Line(StartPoint=move.Geometry, EndPoint=move_5.Geometry)
ln_6 = Line(StartPoint=move.Geometry, EndPoint=[item, divide.Points])  # -> flatten(Line)
ln_7 = Line(StartPoint=move_5.Geometry, EndPoint=pt_5)
ln_8 = Line(StartPoint=move_2.Geometry, EndPoint=move_6.Geometry)
ln_9 = Line(StartPoint=move_2.Geometry, EndPoint=[item_2, divide_2.Points])  # -> flatten(Line)
ln_10 = Line(StartPoint=move_6.Geometry, EndPoint=pt_6)
ln_11 = Line(StartPoint=move_3.Geometry, EndPoint=move_7.Geometry)
ln_12 = Line(StartPoint=move_3.Geometry, EndPoint=[item_3, mirror.Geometry])  # -> flatten(Line)
ln_13 = Line(StartPoint=move_7.Geometry, EndPoint=pt_7)
ln_14 = Line(StartPoint=move_4.Geometry, EndPoint=move_8.Geometry)
vector_display = VectorDisplay(Anchor=list_item_3, Vector=vector_2pt.Vector)
ln_15 = Line(StartPoint=move_4.Geometry, EndPoint=[item_4, mirror_2.Geometry])  # -> flatten(Line)
ln_16 = Line(StartPoint=move_8.Geometry, EndPoint=pt_8)
discontinuity = Discontinuity(Curve=ln_6, Level=1)  # -> Points, Parameters
discontinuity_2 = Discontinuity(Curve=ln_9, Level=1)  # -> Points, Parameters
discontinuity_3 = Discontinuity(Curve=ln_12, Level=1)  # -> Points, Parameters
remove_duplicate_points = RemoveDuplicatePoints(InputPoints=flatten(discontinuity_3.Points), Tolerance=0.001)  # -> OutputPoints, FirstPointIndexes
clean_tree = CleanTree(RemoveNulls=True, RemoveInvalid=True, RemoveEmpty=False, Tree=remove_duplicate_points.OutputPoints)
discontinuity_4 = Discontinuity(Curve=ln_15, Level=1)  # -> Points, Parameters
join = JoinCurves(Curves=[ln_6, ln_7, ln_5], Preserve=False)
polyline = PolyLine(Vertices=flatten(discontinuity_3.Points), Closed=False)
move_13 = Move(Geometry=discontinuity_4.Points, Motion=vector_2pt.Vector)  # -> Geometry, Transform
join_2 = JoinCurves(Curves=[ln_9, ln_10, ln_8], Preserve=False)
join_3 = JoinCurves(Curves=[ln_12, ln_13, ln_11], Preserve=False)
join_4 = JoinCurves(Curves=[ln_15, ln_16, ln_14], Preserve=False)
delaunay_edges = DelaunayEdges(Points=flatten(clean_tree), Plane=PlaneXY(0, 0, 0))  # -> Connectivity, Edges
del = DelaunayMesh(Points=flatten(discontinuity.Points), Plane=PlaneXY(0, 0, 0))
pipe = Pipe(Curve=join, Radius=Slider(0.047, range=0..1), Caps=0)
del_2 = DelaunayMesh(Points=flatten(discontinuity_3.Points), Plane=PlaneXY(0, 0, 0))
pipe_2 = Pipe(Curve=join_3, Radius=Slider(0.047, range=0..1), Caps=0)
del_3 = DelaunayMesh(Points=flatten(discontinuity_4.Points), Plane=PlaneXY(0, 0, 0))
pipe_3 = Pipe(Curve=join_4, Radius=Slider(0.047, range=0..1), Caps=0)
geometry = Geometry(flatten([del_3, pipe_3]))
move_14 = Move(Geometry=pipe_2, Motion=vector_2pt.Vector)  # -> Geometry, Transform
move_15 = Move(Geometry=discontinuity_3.Points, Motion=vector_2pt.Vector)  # -> Geometry, Transform
rotate = Rotate(Geometry=move_15.Geometry, Angle=1.570796327, Plane=list_item_3)  # -> Geometry, Transform
rotate_2 = Rotate(Geometry=discontinuity.Points, Angle=1.570796327, Plane=list_item_3)  # -> Geometry, Transform
point = Point(discontinuity_2.Points)
point_2 = Point(move_13.Geometry)
point_3 = Point(rotate_2.Geometry)
point_4 = Point(rotate.Geometry)
flatten_tree = FlattenTree(Tree=point_3, Path="{0}")
flatten_tree_2 = FlattenTree(Tree=point_4, Path="{0}")
flatten_tree_3 = FlattenTree(Tree=point, Path="{0}")
flatten_tree_4 = FlattenTree(Tree=point_2, Path="{0}")
remove_duplicate_points_2 = RemoveDuplicatePoints(InputPoints=flatten_tree, Tolerance=0.001)  # -> OutputPoints, FirstPointIndexes
remove_duplicate_points_3 = RemoveDuplicatePoints(InputPoints=flatten_tree_2, Tolerance=0.001)  # -> OutputPoints, FirstPointIndexes
remove_duplicate_points_4 = RemoveDuplicatePoints(InputPoints=flatten_tree_3, Tolerance=0.001)  # -> OutputPoints, FirstPointIndexes
remove_duplicate_points_5 = RemoveDuplicatePoints(InputPoints=flatten_tree_4, Tolerance=0.001)  # -> OutputPoints, FirstPointIndexes
clean_tree_2 = CleanTree(RemoveNulls=True, RemoveInvalid=True, RemoveEmpty=False, Tree=remove_duplicate_points_2.OutputPoints)
clean_tree_3 = CleanTree(RemoveNulls=True, RemoveInvalid=True, RemoveEmpty=False, Tree=remove_duplicate_points_3.OutputPoints)
clean_tree_4 = CleanTree(RemoveNulls=True, RemoveInvalid=True, RemoveEmpty=False, Tree=remove_duplicate_points_4.OutputPoints)
clean_tree_5 = CleanTree(RemoveNulls=True, RemoveInvalid=True, RemoveEmpty=False, Tree=remove_duplicate_points_5.OutputPoints)
list_item_5 = ListItem(List=clean_tree_2, Index=0, Wrap=True)  # -> Item, Item1, Item2, Item3, Item4, Item5, Item6
list_item_6 = ListItem(List=clean_tree_3, Index=0, Wrap=True)  # -> Item, Item1, Item2, Item3, Item4, Item5, Item6
list_item_7 = ListItem(List=clean_tree_4, Index=0, Wrap=True)  # -> Item, Item1, Item2, Item3, Item4, Item5, Item6
list_item_8 = ListItem(List=clean_tree_5, Index=0, Wrap=True)  # -> Item, Item1, Item2, Item3, Item4, Item5, Item6
point_5 = Point(list_item_5.Item)
point_6 = Point(list_item_5.Item1)
point_7 = Point(list_item_5.Item2)
point_8 = Point(list_item_5.Item5)
point_9 = Point(list_item_6.Item1)
point_10 = Point(list_item_6.Item2)
point_11 = Point(list_item_6.Item3)
point_12 = Point(list_item_6.Item4)
point_13 = Point(list_item_6.Item5)
point_14 = Point(list_item_6.Item6)
point_15 = Point(list_item_5.Item3)
point_16 = Point(list_item_5.Item4)
point_17 = Point(list_item_5.Item6)
point_18 = Point(list_item_6.Item)
point_19 = Point(list_item_7.Item5)
point_20 = Point(list_item_7.Item)
point_21 = Point(list_item_7.Item1)
point_22 = Point(list_item_7.Item2)
point_23 = Point(list_item_7.Item3)
point_24 = Point(list_item_7.Item4)
point_25 = Point(list_item_7.Item6)
point_26 = Point(list_item_8.Item)
point_27 = Point(list_item_8.Item1)
point_28 = Point(list_item_8.Item2)
point_29 = Point(list_item_8.Item3)
point_30 = Point(list_item_8.Item4)
point_31 = Point(list_item_8.Item5)
point_32 = Point(list_item_8.Item6)
delaunay_mesh = DelaunayMesh(Points=[point_16, point_6, point_5], Plane=PlaneXY(0, 0, 0))
delaunay_mesh_2 = DelaunayMesh(Points=[point_8, point_6, point_5], Plane=PlaneXY(0, 0, 0))
delaunay_mesh_3 = DelaunayMesh(Points=[point_7, point_8, point_5], Plane=PlaneXY(0, 0, 0))
delaunay_mesh_4 = DelaunayMesh(Points=[point_17, point_7, point_5], Plane=PlaneXY(0, 0, 0))
delaunay_mesh_5 = DelaunayMesh(Points=[point_15, point_17, point_5], Plane=PlaneXY(0, 0, 0))
delaunay_mesh_6 = DelaunayMesh(Points=[point_16, point_15, point_5], Plane=PlaneXY(0, 0, 0))
delaunay_mesh_7 = DelaunayMesh(Points=[point_12, point_9, point_18], Plane=PlaneXY(0, 0, 0))
delaunay_mesh_8 = DelaunayMesh(Points=[point_13, point_9, point_18], Plane=PlaneXY(0, 0, 0))
delaunay_mesh_9 = DelaunayMesh(Points=[point_10, point_13, point_18], Plane=PlaneXY(0, 0, 0))
delaunay_mesh_10 = DelaunayMesh(Points=[point_14, point_10, point_18], Plane=PlaneXY(0, 0, 0))
delaunay_mesh_11 = DelaunayMesh(Points=[point_11, point_14, point_18], Plane=PlaneXY(0, 0, 0))
delaunay_mesh_12 = DelaunayMesh(Points=[point_12, point_11, point_18], Plane=PlaneXY(0, 0, 0))
delaunay_mesh_13 = DelaunayMesh(Points=[point_24, point_21, point_20], Plane=PlaneXY(0, 0, 0))
delaunay_mesh_14 = DelaunayMesh(Points=[point_19, point_21, point_20], Plane=PlaneXY(0, 0, 0))
delaunay_mesh_15 = DelaunayMesh(Points=[point_22, point_19, point_20], Plane=PlaneXY(0, 0, 0))
delaunay_mesh_16 = DelaunayMesh(Points=[point_25, point_22, point_20], Plane=PlaneXY(0, 0, 0))
delaunay_mesh_17 = DelaunayMesh(Points=[point_23, point_25, point_20], Plane=PlaneXY(0, 0, 0))
delaunay_mesh_18 = DelaunayMesh(Points=[point_24, point_23, point_20], Plane=PlaneXY(0, 0, 0))
delaunay_mesh_19 = DelaunayMesh(Points=[point_30, point_27, point_26], Plane=PlaneXY(0, 0, 0))
delaunay_mesh_20 = DelaunayMesh(Points=[point_31, point_27, point_26], Plane=PlaneXY(0, 0, 0))
delaunay_mesh_21 = DelaunayMesh(Points=[point_28, point_31, point_26], Plane=PlaneXY(0, 0, 0))
delaunay_mesh_22 = DelaunayMesh(Points=[point_32, point_28, point_26], Plane=PlaneXY(0, 0, 0))
delaunay_mesh_23 = DelaunayMesh(Points=[point_29, point_32, point_26], Plane=PlaneXY(0, 0, 0))
delaunay_mesh_24 = DelaunayMesh(Points=[point_30, point_29, point_26], Plane=PlaneXY(0, 0, 0))
panel_2 = Panel("1, 2, 3")
panel_3 = Panel("3, 4, 6")
panel_4 = Panel("0, 1, 3")
panel_5 = Panel("0, 3, 4")
panel_6 = Panel("2, 3, 5")
panel_7 = Panel("3, 5, 6")
move_16 = Move(Geometry=pipe_3, Motion=vector_2pt.Vector)  # -> Geometry, Transform
rotate_3 = Rotate(Geometry=pipe, Angle=1.570796327, Plane=list_item_3)  # -> Geometry, Transform
rotate_4 = Rotate(Geometry=move_14.Geometry, Angle=1.570796327, Plane=list_item_3)  # -> Geometry, Transform
pipe_4 = Pipe(Curve=join_2, Radius=Slider(0.047, range=0..1), Caps=0)
